# Grasshopper definition Tinyhouse Generator.gh (Grasshopper 1.0.7)
# plug-ins: ArqiShap3D, PTComponentLibrary, Sasquatch, Pufferfish, Magnetizing_FPG

richtung_eingang_0_360 = Slider(90, range=0..360)

breitengrad = Slider(10, range=-90..90)
längengrad = Slider(22.5, range=-90..90)
raumhöhe = Slider(3, range=2.5..4)
raumhöhe_2 = GetNumber(raumhöhe, AtLeast=1, AtMost=1, Maximum=1.797693135e+308, Minimum=-1.797693135e+308, TreeAccess=False)
breitengrad_2 = GetNumber(
    breitengrad,
    AtLeast=1,
    AtMost=1,
    Maximum=1.797693135e+308,
    Minimum=-1.797693135e+308,
    Prompt="Breitengrad",
    TreeAccess=False)
längengrad_2 = GetNumber(
    längengrad,
    AtLeast=1,
    AtMost=1,
    Maximum=1.797693135e+308,
    Minimum=-1.797693135e+308,
    Prompt="Längengrad",
    TreeAccess=False)
num = Number(raumhöhe_2)
panel = Panel("C:\Users\mfls\OneDrive\Uni\Master\Code\Tinyhouse Generator\files\EpwZipUrls.csv")
python = GhPythonScript(csv_path=panel, target_lat=längengrad_2, target_lon=breitengrad_2)  # -> nearest_station_url, shortest_distance
# ---------- python: Python ----------
__author__ = "mfls"
__version__ = "2024.06.07"
        
import rhinoscriptsyntax as rs
import math

nearest_station_url = None
shortest_distance = float('inf')

def haversine(lat1, lon1, lat2, lon2):
    # Convert decimal degrees to radians
    lat1, lon1, lat2, lon2 = map(math.radians, [lat1, lon1, lat2, lon2])

    # Haversine formula 
    dlat = lat2 - lat1 
    dlon = lon2 - lon1 
    a = math.sin(dlat/2)**2 + math.cos(lat1) * math.cos(lat2) * math.sin(dlon/2)**2
    c = 2 * math.asin(math.sqrt(a)) 
    r = 6371.0088 # Radius of earth
    return c * r

# CSV open and read
file = open(csv_path, 'r')
lines = file.readlines()

file.close()

# Skip the header row if it exists and doesnt include information
header = lines[0].strip().split(';')
if header[1].lower() == 'lat' and header[2].lower() == 'lon':
    lines = lines[1:]

for line in lines:
    line = line.strip("\n")
    
    # Split line with comma: creates individual lists of strings
    csvInfo = line.split(';')
    lat = float(csvInfo[1])
    lon = float(csvInfo[2])
    distance = haversine(target_lat, target_lon, lat, lon) 
    if distance < shortest_distance:
            shortest_distance = distance
            nearest_station_url = csvInfo[3]
# ---------- end python ----------
panel_2 = Panel(python.nearest_station_url)
num_2 = Number(python.shortest_distance)
panel_3 = Panel(num_2)

klimazone = GetString("Cfc Temperate-Withouth_dry_season-Cold_Summer", AtLeast=1, AtMost=1, Prompt="Klimazone", TreeAccess=False)
# https://www.sciencedirect.com/science/article/pii/S0038092X16002188#:~:text=Window%2Dto%2Dwall%20ratio%20(,not%20for%20south%2Dfacing%20fa%C3%A7ades.
panel_4 = Panel(klimazone)
txt = Text(panel_4)

panel_5 = Panel("C:\Users\mfls\OneDrive\Uni\Master\Code\Tinyhouse Generator\files\EpwZipUrls.csv")
python_2 = GhPythonScript(csv_path=panel_5, target_lat=Slider(22.5, range=-90..90), target_lon=Slider(10, range=-90..90))  # -> nearest_station_url, shortest_distance; same code as python
panel_6 = Panel(python_2.nearest_station_url)

panel_7 = Panel("C:\Users\mfls\OneDrive\Uni\Master\Code\Tinyhouse Generator\files\ClimateLookupTable.csv")
panel_8 = Panel("Dachaufbau höhe")  # disabled
panel_9 = Panel("Kurve ganz Außen")  # disabled
panel_10 = Panel("Brep Dach Außen")  # disabled
python_3 = GhPythonScript(csv_path=panel_7, Klimazone=txt)  # -> Temperatur, Feuchtigkeit, Tragwerk, Dämmung, Belüftet, Dach, Dachüberstand, WWR_Nord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
# ---------- python_3: Python ----------
__author__ = "mfls"
__version__ = "2024.06.07"

import rhinoscriptsyntax as rs

# Function to search for a specific climate zone in the CSV and return its values
def search_climate_zone(csv_path, target_klimazone):
    # Initialize variables for output
    Temperatur = None
    Feuchtigkeit = None
    Tragwerk = None
    Dämmung = None
    Belüftet = None
    Dach = None
    Dachüberstand = None
    WWR_Nord = None
    WWR_Ost = None
    WWR_Süd = None
    WWR_West = None
    Seitenverhältnis_y_x = None

    # Open and read the CSV file
    file = open(csv_path, 'r')
    lines = file.readlines()
    file.close()

    # Skip the header row
    header = lines[0].strip().split(';')
    lines = lines[1:]

    # Iterate through the CSV lines
    for line in lines:
        line = line.strip("\n")
        
        # Split the line into individual fields
        csvInfo = line.split(';')
        
        # Check if the Klimazone matches the target Klimazone
        if csvInfo[0] == target_klimazone:
            Temperatur = csvInfo[1]
            Feuchtigkeit = csvInfo[2]
            Tragwerk = csvInfo[3]
            Dämmung = csvInfo[4]
            Belüftet = csvInfo[5]
            Dach = csvInfo[6]
            Dachüberstand = csvInfo[7]
            WWR_Nord = csvInfo[8]
            WWR_Ost = csvInfo[9]
            WWR_Süd = csvInfo[10]
            WWR_West = csvInfo[11]
            Seitenverhältnis_y_x = csvInfo[12]
            break

    # Outputs
    return Temperatur, Feuchtigkeit, Tragwerk, Dämmung, Belüftet, Dach, Dachüberstand, WWR_Nord, WWR_Ost, WWR_Süd, WWR_West, Seitenverhältnis_y_x

target_klimazone = Klimazone

# Call the function and get the outputs
Temperatur, Feuchtigkeit, Tragwerk, Dämmung, Belüftet, Dach, Dachüberstand, WWR_Nord, WWR_Ost, WWR_Süd, WWR_West, Seitenverhältnis_y_x = search_climate_zone(csv_path, target_klimazone)

# Set the outputs for Grasshopper
Temperatur = Temperatur
Feuchtigkeit = Feuchtigkeit
Tragwerk = Tragwerk
Dämmung = Dämmung
Belüftet = Belüftet
Dach = Dach
Dachüberstand = Dachüberstand
WWR_Nord = WWR_Nord
WWR_Ost = WWR_Ost
WWR_Süd = WWR_Süd
WWR_West = WWR_West
Seitenverhältnis_y_x = Seitenverhältnis_y_x
# ---------- end python_3 ----------
ladybug = Ladybug_Ladybug()  # -> Vviiiiiiiiiizzz; disabled; plug-in component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
panel_11 = Panel("http://climate.onebuilding.org/WMO_Region_4_North_and_Central_America/USA_United_States_of_America/NC_North_Carolina/USA_NC_Charlotte.Douglas.Intl.AP.723140_TMY3.zip")  # disabled
panel_12 = Panel(python_3.Temperatur)
panel_13 = Panel(python_3.Feuchtigkeit)
downloadepw = LBDownloadWeather(weather_URL=panel_6)  # -> epw_file, stat_file, ddy_file; disabled; plug-in component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
srf = Surface(<surface referenced from the Rhino model>)  # disabled
downloadepw_2 = LBDownloadWeather(weather_URL=panel_11)  # -> epw_file, stat_file, ddy_file; disabled; plug-in component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
num_3 = Number(python_3.Seitenverhältnis_y_x)
toggle = BooleanToggle(True)  # disabled
division = Division(A=python_3.Dämmung, B="100")
importepw = LBImportEPW(epw_file=downloadepw_2.epw_file)  # -> location, dry_bulb_temperature, dew_point_temperature, relative_humidity, wind_speed, wind_direction, direct_normal_rad, diffuse_horizontal_rad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; disabled; plug-in component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
python_4 = GhPythonScript(seitenverhältnis_y_x=num_3, grundrissfläche=Slider(40, range=0..100))  # -> x, y
# ---------- python_4: Python ----------
__author__ = "mfls"
__version__ = "2024.06.07"

import rhinoscriptsyntax as rs

def calculate_dimensions(seitenverhältnis_y_x, area):
    """
    Berechnet die Dimensionen x und y eines Rechtecks basierend auf dem Seitenverhältnis y/x und der Grundrissfläche.

    Args:
    y_x_ratio (float): Das Seitenverhältnis y/x.
    area (float): Die gewünschte Grundrissfläche.

    Returns:
    tuple: Die berechneten Werte für x und y.
    """
    # y = ratio * x
    # area = x * y
    # area = x * (y_x_ratio * x)
    # area = y_x_ratio * x^2
    # x^2 = area / y_x_ratio
    # x = sqrt(area / y_x_ratio)
    
    import math
    x = math.sqrt(area / seitenverhältnis_y_x)
    y = seitenverhältnis_y_x * x
    
    return x, y

# Beispielhafte Verwendung
seitenverhältnis_y_x = seitenverhältnis_y_x
area = grundrissfläche
# Berechne x und y
x, y = calculate_dimensions(seitenverhältnis_y_x, area)

# Setze die Ausgaben für Grasshopper
x = x
y = y
# ---------- end python_4 ----------
tof = Ladybug_TiltAndOrientationFactor(
    epwFile=downloadepw.epw_file,
    PV_SWHsurface=srf,
    annualShading=0,
    north=0,
    precision=2,
    scale=1,
    bakeIt=False,
    runIt=toggle)  # -> readMe, port, TOF, TSRF, PVsurfaceTilt, PVsurfaceAzimuth, optimalTilt, optimalAzimuth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; disabled; plug-in component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
tmatch = MatchText(Text=python_3.Tragwerk, Pattern="Holz", Case=True)
tmatch_2 = MatchText(Text=python_3.Dach, Pattern="Flachdach", Case=True)
rectangle = Rectangle(Plane=PlaneXY(0, 0, 0), XSize=python_4.x, YSize=python_4.y, Radius=0)  # -> Rectangle, Length
decnstrloc = LBDeconstructLocation(location=importepw.location)  # -> name, latitude, longitude, time_zone, elevation; disabled; plug-in component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
skymatrix = LBCumulativeSkyMatrix(location=importepw.location, direct_rad=importepw.direct_normal_rad, diffuse_rad=importepw.diffuse_horizontal_rad)  # -> report, sky_mtx; disabled; plug-in component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
toggle_2 = BooleanToggle(True)  # disabled
number_slider = Slider(0.5, range=0.1..1)  # disabled
bool = Boolean(tmatch)
num_4 = Number(division)
bool_2 = Boolean(python_3.Belüftet)
bool_3 = Boolean(tmatch_2)
num_5 = Number(python_3.Dachüberstand)
num_6 = Number(python_3.WWR_Nord)
num_7 = Number(python_3.WWR_Ost)
num_8 = Number(python_3.WWR_Süd)
num_9 = Number(python_3.WWR_West)
crv = Curve(rectangle.Rectangle)
panel_14 = Panel(tof.optimalRadiation)  # disabled
panel_15 = Panel(tof.optimalAzimuth)  # disabled
panel_16 = Panel(tof.optimalTilt)  # disabled
panel_17 = Panel(decnstrloc.name)  # disabled
panel_18 = Panel(decnstrloc.latitude)  # disabled
panel_19 = Panel(decnstrloc.longitude)  # disabled
panel_20 = Panel("WWR Nord")
panel_21 = Panel(num_6)
panel_22 = Panel("WWR Ost")
panel_23 = Panel(num_7)
panel_24 = Panel("WWR Süd")
panel_25 = Panel(num_8)
panel_26 = Panel("WWR West")
panel_27 = Panel(num_9)
panel_28 = Panel("Beton")
panel_29 = Panel("Holz")
panel_30 = Panel("Dämmung")
panel_31 = Panel("Abdichtung")
panel_32 = Panel("Putz")
panel_33 = Panel("Ziegel")
panel_34 = Panel("Außenwand")
panel_35 = Panel("Metall")
panel_36 = Panel("Glas")
area = Area(Geometry=crv)  # -> Area, Centroid
create_material = CreateMaterial(
    Diffuse=ColourSwatch(SwatchColor=RGB(204, 204, 204)),
    Specular=RGB(255, 255, 255),
    Emission=RGB(0, 0, 0),
    Transparency=0,
    Shine=Slider(0, range=0..100))
create_material_2 = CreateMaterial(
    Diffuse=ColourSwatch(SwatchColor=RGB(245, 206, 152)),
    Specular=RGB(255, 255, 255),
    Emission=RGB(0, 0, 0),
    Transparency=0,
    Shine=Slider(10, range=0..100))
create_material_3 = CreateMaterial(
    Diffuse=ColourSwatch(SwatchColor=RGB(221, 232, 21)),
    Specular=RGB(255, 255, 255),
    Emission=RGB(0, 0, 0),
    Transparency=0,
    Shine=Slider(0, range=0..100))
create_material_4 = CreateMaterial(
    Diffuse=ColourSwatch(SwatchColor=RGB(0, 0, 0)),
    Specular=RGB(255, 255, 255),
    Emission=RGB(0, 0, 0),
    Transparency=0,
    Shine=Slider(4, range=0..100))
create_material_5 = CreateMaterial(
    Diffuse=ColourSwatch(SwatchColor=RGB(30, 45, 74)),
    Specular=RGB(255, 255, 255),
    Emission=RGB(0, 0, 0),
    Transparency=0,
    Shine=Slider(5, range=0..100))
create_material_6 = CreateMaterial(
    Diffuse=ColourSwatch(SwatchColor=RGB(176, 176, 176)),
    Specular=RGB(255, 255, 255),
    Emission=RGB(0, 0, 0),
    Transparency=0,
    Shine=Slider(0, range=0..100))
create_material_7 = CreateMaterial(
    Diffuse=ColourSwatch(SwatchColor=RGB(176, 176, 176)),
    Specular=RGB(255, 255, 255),
    Emission=RGB(0, 0, 0),
    Transparency=0,
    Shine=Slider(2, range=0..100))
create_material_8 = CreateMaterial(
    Diffuse=ColourSwatch(SwatchColor=RGB(224, 224, 224)),
    Specular=RGB(255, 255, 255),
    Emission=RGB(0, 0, 0),
    Transparency=0,
    Shine=Slider(0, range=0..100))
create_material_9 = CreateMaterial(
    Diffuse=ColourSwatch(SwatchColor=RGB(255, 255, 255)),
    Specular=RGB(255, 255, 255),
    Emission=RGB(0, 0, 0),
    Transparency=Slider(0.8, range=0..1),
    Shine=0)
offset = OffsetCurve(Curve=crv, Distance="0.5", Corners=1)
dom = ConstructDomain(DomainStart="0", DomainEnd="360")
dom_2 = ConstructDomain(DomainStart="0", DomainEnd="1")
num_10 = Number(richtung_eingang_0_360)
remap = RemapNumbers(Value=num_10, Source=dom, Target=dom_2)  # -> Mapped, Clipped
xy = XYPlane(Origin=area.Centroid)
cir = Circle(Plane=area.Centroid, Radius=area.Area)
flip = FlipCurve(Curve=cir)  # -> Curve, Flag
rad = Radians(Degrees="90")
rotate = Rotate(Geometry=flip.Curve, Angle=rad, Plane=xy)  # -> Geometry, Transform
eval = EvaluateCurve(Curve=reparameterize(rotate.Geometry), Parameter=remap.Mapped)  # -> Point, Tangent, Angle
crv_cp = CurveClosestPoint(Point=eval.Point, Curve=offset)  # -> Point, Parameter, Distance
panel_37 = Panel("Form Vorschlag")
panel_38 = Panel("Richtung Eingang")
roominstance = RoomInstance()
crv_2 = Curve(crv)
pt = Point(crv_cp.Point)
roominstance_2 = RoomInstance()
roominstance_3 = RoomInstance()
roominstance_4 = RoomInstance()
area_2 = Area(Geometry=crv_2)  # -> Area, Centroid
panel_39 = Panel(area_2.Area)
houseinstance = HouseInstance(Boundary=crv_2, EntrancePoint=pt)
magnetizing_fpg = MagnetizingRooms_ES(
    HouseInstance=houseinstance,
    Iterations=Slider(900, range=0..1000),
    MaxAdjDistance=Slider(3, range=0..10),
    CellSizeM=Slider(0.8, range=0..1))  # -> Corridors, RoomBreps, RoomNames, Adjacencies, MissingAdjacences, Boundary, BoundaryOffset
pt_2 = Point(Point(-7.407236404, -0.0234716752, 0))
compass = LBCompass(center=pt_2, scale=Slider(0.2, range=0..1))  # -> compass; plug-in component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
brep = Brep(magnetizing_fpg.Corridors)
brep_2 = Brep(magnetizing_fpg.RoomBreps)
join = BrepJoin(Breps=flatten([brep, brep_2]))  # -> Breps, Closed
cluster = Cluster_2(
    brep_2=magnetizing_fpg.Corridors,
    brep=magnetizing_fpg.RoomBreps,
    txt_2=magnetizing_fpg.RoomNames,
    txt=magnetizing_fpg.Adjacencies,
    int=magnetizing_fpg.MissingAdjacences,
    crv=magnetizing_fpg.Boundary,
    crv_2=magnetizing_fpg.BoundaryOffset)
edges = BrepEdges(Brep=join.Breps)  # -> Naked, Interior, NonManifold
join_2 = JoinCurves(Curves=edges.Naked, Preserve=False)
area_3 = Area(Geometry=join_2)  # -> Area, Centroid
cls = Closed(Curve=join_2)  # -> Closed, Periodic
crv_3 = Curve(join_2)
panel_40 = Panel(cls.Closed)
panel_41 = Panel(area_3.Area)
simplify = SimplifyCurve(Curve=crv_3)  # -> Curve, Simplified
flip_2 = FlipCurve(Curve=simplify.Curve)  # -> Curve, Flag
panel_42 = Panel("Auswahl Aus CSV")
bool_4 = Boolean(bool)
dispatch = Dispatch(List=flip_2.Curve, DispatchPattern=bool_4)  # -> ListA, ListB
panel_43 = Panel("Kurve Original Grundriss")
crv_4 = Curve(flip_2.Curve)
Z = UnitZ(Factor=1)
debrep = DeconstructBrep(Brep=crv_4)  # -> Faces, Edges, Vertices
md_slider = MDSlider(SliderMode=0, slider_value=Point(0.5, 0.5, 0.5), x_domain=Domain(0, 1), y_domain=Domain(0, 1), z_domain=Domain(0, 1))
extr = Extrude(Base=debrep.Edges, Direction=Z)
evalsrf = EvaluateSurface(Surface=reparameterize(extr), Point=md_slider)  # -> Point, Normal, UDirection, VDirection, Frame
xy_2 = XYPlane(Origin=Point(0, 0, 0))
Y = UnitY(Factor=1)
panel_44 = Panel("Text Raumname")
angle = Angle(VectorA=evalsrf.Normal, VectorB=Y, Plane=xy_2)  # -> Angle, Reflex
panel_46 = Panel("Eingangspunkt")
txt_2 = Text(magnetizing_fpg.RoomNames)
panel_47 = Panel("Brep Räume")
crv_5 = Curve(flip_2.Curve)
deg = Degrees(Radians=angle.Angle)
pt_3 = Point(pt)
tmatch_3 = MatchText(Text=txt_2, Pattern="Schlafraum", Case=True)
tmatch_4 = MatchText(Text=txt_2, Pattern="Bad", Case=True)
brep_3 = Brep(magnetizing_fpg.RoomBreps)
debrep_2 = DeconstructBrep(Brep=crv_5)  # -> Faces, Edges, Vertices
cull = CullPattern(List=brep_3, CullPattern=tmatch_3)
cull_2 = CullPattern(List=brep_3, CullPattern=tmatch_4)

# ---- group: Osten
smaller = SmallerThan(FirstNumber=deg, SecondNumber="135")  # -> SmallerThan, OrEqualTo
larger = LargerThan(FirstNumber=deg, SecondNumber="45")  # -> LargerThan, OrEqualTo
and = GateAnd(A=larger.LargerThan, B=smaller.OrEqualTo)
dispatch_2 = Dispatch(List=debrep.Edges, DispatchPattern=and)  # -> ListA, ListB
data = Data(dispatch_2.ListA)

# ---- group: Westen
larger_2 = LargerThan(FirstNumber=deg, SecondNumber="225")  # -> LargerThan, OrEqualTo
smaller_2 = SmallerThan(FirstNumber=deg, SecondNumber="315")  # -> SmallerThan, OrEqualTo
and_2 = GateAnd(A=larger_2.LargerThan, B=smaller_2.OrEqualTo)
dispatch_3 = Dispatch(List=debrep.Edges, DispatchPattern=and_2)  # -> ListA, ListB
data_2 = Data(dispatch_3.ListA)

# ---- group: Süden
larger_3 = LargerThan(FirstNumber=deg, SecondNumber="135")  # -> LargerThan, OrEqualTo
smaller_3 = SmallerThan(FirstNumber=deg, SecondNumber="225")  # -> SmallerThan, OrEqualTo
and_3 = GateAnd(A=larger_3.LargerThan, B=smaller_3.OrEqualTo)
dispatch_4 = Dispatch(List=debrep.Edges, DispatchPattern=and_3)  # -> ListA, ListB
data_3 = Data(dispatch_4.ListA)

# ----
merge = Merge(Data1=cull, Data2=cull_2)

# ---- group: Norden
smaller_4 = SmallerThan(FirstNumber=deg, SecondNumber="45")  # -> SmallerThan, OrEqualTo
larger_4 = LargerThan(FirstNumber=deg, SecondNumber="315")  # -> LargerThan, OrEqualTo
or = GateOr(A=smaller_4.OrEqualTo, B=larger_4.LargerThan)
dispatch_5 = Dispatch(List=debrep.Edges, DispatchPattern=or)  # -> ListA, ListB
data_4 = Data(dispatch_5.ListA)

# ----
edges_2 = BrepEdges(Brep=merge)  # -> Naked, Interior, NonManifold
join_3 = JoinCurves(Curves=edges_2.Naked, Preserve=False)
breite_tür_und_rahmen = Number(Slider(2, range=0..2))
simplify_2 = SimplifyCurve(Curve=join_3)  # -> Curve, Simplified
crv_6 = Curve(simplify_2.Curve)
explode = Explode(Curve=crv_6, Recursive=True)  # -> Segments, Vertices
panel_48 = Panel("Grundriss Kurve")
midpt = CurveMiddle(Curve=explode.Segments)
crv_7 = Curve(simplify.Curve)
crv_cp_2 = CurveClosestPoint(Point=midpt, Curve=crv_7)  # -> Point, Parameter, Distance
larger_5 = LargerThan(FirstNumber=crv_cp_2.Distance, SecondNumber="0.01")  # -> LargerThan, OrEqualTo
cull_3 = CullPattern(List=explode.Segments, CullPattern=larger_5.LargerThan)
wo_tür = Slider(0.5, range=0..1)
num_11 = Number(num_6)
num_12 = Number(num_8)
num_13 = Number(num_9)
num_14 = Number(num_7)
end = EndPoints(Curve=cull_3)  # -> Start, End
Z_2 = UnitZ(Factor=1)
crv_8 = Curve(cull_3)
# Weiterleitung an Fenster Cut
pt_4 = Point([end.Start, end.End])
md_slider_2 = MDSlider(SliderMode=0, slider_value=Point(0.5, 0.5, 0.5), x_domain=Domain(0, 1), y_domain=Domain(0, 1), z_domain=Domain(0, 1))
bang = ExplodeTree(Data=crv_8)  # -> _000000, _000100
midpt_2 = CurveMiddle(Curve=crv_8)  # -> graft(Midpoint)
breite_tür = Slider(1, range=0..1)
höhe_tür = Slider(2, range=0..2)
bang_2 = ExplodeTree(Data=crv_8)  # -> _000000, _000100
crv_cp_3 = CurveClosestPoint(Point=midpt_2, Curve=bang._000000)  # -> Point, Parameter, Distance
crv_cp_4 = CurveClosestPoint(Point=midpt_2, Curve=bang_2._000100)  # -> Point, Parameter, Distance
bnd = Bounds(Numbers=crv_cp_3.Distance)
panel_49 = Panel("Daten Fensterfläche")
bnd_2 = Bounds(Numbers=crv_cp_4.Distance)
multiplication = Multiplication(A=breite_tür, B="-0.5")
dedomain = DeconstructDomain(Domain=bnd)  # -> Start, End
dedomain_2 = DeconstructDomain(Domain=bnd_2)  # -> Start, End
trim = TrimTree(Tree=dedomain.Start, Depth=1)
panel_50 = Panel("Dicke Wandaufbau gesamt")
trim_2 = TrimTree(Tree=dedomain_2.Start, Depth=1)
equals = Equality(FirstNumber=trim, SecondNumber="0")  # -> Equality, Inequality
panel_51 = Panel("Output Data Metall")
panel_52 = Panel("Output Data Glas")
equals_2 = Equality(FirstNumber=trim_2, SecondNumber="0")  # -> Equality, Inequality
cull_4 = CullPattern(List=crv_8, CullPattern=equals.Inequality)
cull_5 = CullPattern(List=crv_8, CullPattern=equals_2.Inequality)
panel_54 = Panel("Türhöhe")
num_15 = Number(höhe_tür)
equals_3 = Equality(FirstNumber=[cull_5, cull_4], SecondNumber=crv_8)  # -> Equality, Inequality
Z_3 = UnitZ(Factor=num_15)
cull_6 = CullPattern(List=crv_8, CullPattern=equals_3.Inequality)
panel_55 = Panel("Innere Ecken Oben")
panel_56 = Panel("Innere Ecken Unten")
len = Length(Curve=flatten(cull_6))
bnd_3 = Bounds(Numbers=len)
panel_57 = Panel("Äußere Ecken Oben")
panel_58 = Panel("Äußere Ecken Unten")
dedomain_3 = DeconstructDomain(Domain=bnd_3)  # -> Start, End
equals_4 = Equality(FirstNumber=dedomain_3.End, SecondNumber=cull_6)  # -> Equality, graft(Inequality)
cull_7 = CullPattern(List=cull_6, CullPattern=equals_4.Inequality)
merge_2 = Merge(Data1=cull_5, Data2=cull_4, Data3=cull_7)
panel_59 = Panel("Tangente Vektor")
panel_60 = Panel("Unten")
panel_61 = Panel("Oben")
panel_62 = Panel("1")
panel_63 = Panel("2")
panel_64 = Panel("Dicke Fußplatte")
crv_9 = Curve(merge_2)
dicke_rahmen = Slider(0.05, range=0..0.1)
join_4 = JoinCurves(Curves=merge_2, Preserve=False)
multiplication_2 = Multiplication(B="10")
panel_66 = Panel("Raumhöhe")
number_slider_2 = Slider(0.01, range=0..0.01)
len_2 = Length(Curve=crv_9)
breite_tür_und_rahmen_2 = Number(Slider(0.9, range=0..2))
Z_4 = UnitZ(Factor=multiplication_2)
larger_6 = LargerThan(FirstNumber=len_2, SecondNumber=breite_tür_und_rahmen_2)  # -> LargerThan, OrEqualTo
panel_67 = Panel("Logik Dachform Wechsel")
panel_68 = Panel("Unten-> Walmdach")
dispatch_6 = Dispatch(List=Z_4, DispatchPattern=bool_3)  # -> ListA, ListB
Z_5 = UnitZ(Factor=number_slider_2)
neg = Negative(Value=dicke_rahmen)
panel_70 = Panel("Oben -> Flachdach")
panel_71 = Panel("Dicke Rahmen")
cull_8 = CullPattern(List=crv_9, CullPattern=larger_6.LargerThan)
number_slider_3 = Slider(0.1, range=0..0.1)

# ---- group: Türplatzierung ohne Innenwand
panel_74 = Panel("Dicke Wandaufbau Innenände")
panel_75 = Panel("Punkte Innenwände")
pt_5 = Point(pt_4)
num_16 = Number(number_slider_3)
sph = Sphere(Base=pt_5, Radius=num_16)
trim_3 = TrimWithBreps(Curve=debrep_2.Edges, Brep=flatten(sph))  # -> Inside, Outside
crv_10 = Curve(flatten(trim_3.Outside))
panel_76 = Panel(crv_10)

# ----
len_3 = Length(Curve=crv_10)
larger_7 = LargerThan(FirstNumber=len_3, SecondNumber=breite_tür_und_rahmen)  # -> LargerThan, OrEqualTo
cull_9 = CullPattern(List=crv_10, CullPattern=larger_7.LargerThan)
crv_cp_5 = CurveClosestPoint(Point=pt_3, Curve=cull_9)  # -> Point, Parameter, Distance
bnd_4 = Bounds(Numbers=crv_cp_5.Distance)
dedomain_4 = DeconstructDomain(Domain=bnd_4)  # -> Start, End
equals_5 = Equality(FirstNumber=crv_cp_5.Distance, SecondNumber=dedomain_4.Start)  # -> Equality, Inequality
cull_10 = CullPattern(List=cull_9, CullPattern=equals_5.Equality)
extr_2 = Extrude(Base=cull_10, Direction=Z_2)
eval_2 = EvaluateCurve(Curve=reparameterize(cull_10), Parameter=wo_tür)  # -> Point, Tangent, Angle
evalsrf_2 = EvaluateSurface(Surface=reparameterize(extr_2), Point=md_slider_2)  # -> Point, Normal, UDirection, VDirection, Frame
pt_6 = Point(eval_2.Point)
vec = Vector(eval_2.Tangent)
pl = ConstructPlane(Origin=pt_6, XAxis=vec, YAxis=evalsrf_2.Normal)
multiplication_3 = Multiplication(A=vec, B=multiplication)
vec_2 = Vector(evalsrf_2.Normal)
pt_7 = Point(pt_6)
vec_3 = Vector(vec)
multiplication_4 = Multiplication(A=vec_3, B="0.5")
multiplication_5 = Multiplication(A=vec_3, B="-0.5")
move = Move(Geometry=pt_7, Motion=multiplication_4)  # -> Geometry, Transform
move_2 = Move(Geometry=pt_7, Motion=multiplication_5)  # -> Geometry, Transform
move_3 = Move(Geometry=move_2.Geometry, Motion=Z_3)  # -> Geometry, Transform
move_4 = Move(Geometry=move.Geometry, Motion=Z_3)  # -> Geometry, Transform
vec_4 = Vector(vec)
move_5 = Move(Geometry=move_2.Geometry, Motion=Z_5)  # -> Geometry, Transform
move_6 = Move(Geometry=move.Geometry, Motion=Z_5)  # -> Geometry, Transform
multiplication_6 = Multiplication(A=vec_4, B=dicke_rahmen)
vec_5 = Vector(multiplication_6)
rev = Reverse(Vector=vec_5)
num_17 = Number(number_slider_2)
num_18 = Number(dicke_rahmen)
extr_3 = Extrude(Base=join_4, Direction=dispatch_6.ListB)
move_7 = Move(Geometry=move_6.Geometry, Motion=rev)  # -> Geometry, Transform
move_8 = Move(Geometry=move_5.Geometry, Motion=vec_5)  # -> Geometry, Transform
num_19 = Number(höhe_tür)
clean = CleanTree(RemoveNulls=True, RemoveInvalid=True, RemoveEmpty=Toggle(True), Tree=cull_8)
addition = Addition(A=num_17, B=num_18)
subtraction = Subtraction(A=num_19, B=addition)
offsetbrep = OffsetBrep(Brep=extr_3, OffsetDistance=number_slider_3, Solid=Toggle(True), SharpEdges=True, Tolerance=0.01)
Z_6 = UnitZ(Factor=1)
panel_77 = Panel("Türblatt Grundform")
panel_78 = Panel("Dach Brep")
höhe_tür_2 = Slider(2, range=0..2)
breite_tür_2 = Slider(0.8, range=0..1)
extr_4 = Extrude(Base=clean, Direction=Z_6)
md_slider_3 = MDSlider(SliderMode=0, slider_value=Point(0.5, 0.5, 0.5), x_domain=Domain(0, 1), y_domain=Domain(0, 1), z_domain=Domain(0, 1))
join_5 = BrepJoin(Breps=flatten(offsetbrep))  # -> Breps, Closed
eval_3 = EvaluateCurve(Curve=reparameterize(clean), Parameter="0.5")  # -> Point, Tangent, Angle
Z_7 = UnitZ(Factor=subtraction)
Z_8 = UnitZ(Factor="10")
evalsrf_3 = EvaluateSurface(Surface=reparameterize(extr_4), Point=md_slider_3)  # -> Point, Normal, UDirection, VDirection, Frame
pt_8 = Point(eval_3.Point)
vec_6 = Vector(eval_3.Tangent)
move_9 = Move(Geometry=move_8.Geometry, Motion=Z_7)  # -> Geometry, Transform
move_10 = Move(Geometry=move_7.Geometry, Motion=Z_7)  # -> Geometry, Transform
pline = PolyLine(Vertices=[move_8.Geometry, move_7.Geometry, move_10.Geometry, move_9.Geometry], Closed=Toggle(True))
fpatch = FragmentPatch(Boundary=pline)
multiplication_7 = Multiplication(A=breite_tür_2, B="-0.5")
pl_2 = ConstructPlane(Origin=pt_8, XAxis=vec_6, YAxis=evalsrf_3.Normal)
panel_80 = Panel("Normal Vektor Wand")
panel_81 = Panel("Dicke Innenwand")
vec_7 = Vector(evalsrf_2.Normal)
multiplication_8 = Multiplication(A=vec_6, B=multiplication_7)
num_20 = Number(number_slider_3)
rectangle_2 = Rectangle(Plane=pl_2, XSize=breite_tür_2, YSize=num_20, Radius=0)  # -> Rectangle, Length
move_11 = Move(Geometry=rectangle_2.Rectangle, Motion=multiplication_8)  # -> Geometry, Transform
md_slider_4 = MDSlider(
    SliderMode=0,
    slider_value=Point(0.4426410044, 0.2189917471, 0.5),
    x_domain=Domain(0, 1),
    y_domain=Domain(0, 1),
    z_domain=Domain(0, 1))
boxrec = BoxRectangle(Rectangle=move_11.Geometry, Height=höhe_tür_2)  # -> flatten(Box)
number_slider_4 = Slider(0.02, range=0..0.1)
panel_82 = Panel("Output Data Holz")
neg_2 = Negative(Value=number_slider_4)
panel_83 = Panel("Output Data Putz")
# Logik Dicke zweite Dämmschicht Holz
panel_85 = Panel("Dämmstärke aus CSV")
dicke_diffusionsoffene_schicht = Slider(0.011, range=0.011..0.02)
dicke_latte_luftschicht = Slider(0.05, range=0..0.8)
dicke_osb = Slider(0.02, range=0.01..0.02)
dicke_gipskarton = Slider(0.02, range=0.01..0.02)
dicke_innenputz = Slider(0.02, range=0..0.02)
y_holzständer = Slider(0.2, range=0..0.8)
x_holzständer = Slider(0.06, range=0..0.5)
grundriss = Curve(dispatch.ListA)
raumhöhe_3 = Number(num)
num_21 = Number(raumhöhe_3)
Z_9 = UnitZ(Factor=num_21)
dispatch_7 = Dispatch(List=Z_9, DispatchPattern=bool_3)  # -> ListA, ListB
extr_5 = Extrude(Base=join_4, Direction=dispatch_7.ListA)
offsetbrep_2 = OffsetBrep(Brep=extr_5, OffsetDistance=Slider(0.1, range=0..0.1), Solid=Toggle(True), SharpEdges=True, Tolerance=0.01)
join_6 = BrepJoin(Breps=flatten(offsetbrep_2))  # -> Breps, Closed
# Dach Brep Unterseite
# Verteilung
panel_86 = Panel("""Raumhöhe
Verteilung""")
panel_87 = Panel("Dicke Dämmschicht CSV")
dicke_innenputz_2 = Slider(0.02, range=0..0.02)
dicke_abdichtung = Slider(0.011, range=0.011..0.02)
dicke_außenputz = Slider(0.02, range=0.01..0.02)
dicke_wand = Slider(0.2, range=0.1..0.4)
panel_88 = Panel("Dach Brep Unterseite")
num_22 = Number(num_4)
raumhöhe_4 = Number(num)
# Raumhöhe x 10 um Cutoff zu generieren
num_23 = Number(raumhöhe_4)
crv_11 = Curve(dispatch.ListB)
dicke_innenputz_3 = Number(dicke_innenputz)
dicke_latte_luftschicht_2 = Number(dicke_latte_luftschicht)
dicke_diffusionsoffene_schicht_2 = Number(dicke_diffusionsoffene_schicht)
dicke_gk = Number(dicke_gipskarton)
dicke_wand_2 = Number(y_holzständer)
num_24 = Number(dicke_wand_2)
subtraction_2 = Subtraction(A=num_4, B=num_24)
smaller_5 = SmallerThan(FirstNumber=subtraction_2, SecondNumber="0")  # -> SmallerThan, OrEqualTo
p_n_c = PickNChoose(Pattern=smaller_5.OrEqualTo, Stream0=subtraction_2, Stream1="0")
num_25 = Number(p_n_c)
dicke_zweite_dämmschicht = Number(num_25)
num_26 = Number(x_holzständer)
dicke_osb_2 = Number(dicke_osb)

# ---- group: Logik Wanddicken
# Boolean Switch Holz Stein
# Boolean Switch Holz Stein
# Boolean Switch Holz Stein
# Boolean Switch Holz Stein
# Dicke zweite Dämmschicht Holz
# Boolean Switch Holz Stein
# Boolean Switch Holz Stein
# Dicke OSB + GK Holz
panel_89 = Panel("0")
panel_90 = Panel("Dicke Putz Massiv")
panel_91 = Panel("Dicke Abdichtung Massiv")
panel_92 = Panel("Dicke Diffusionsof. S. Holz")
panel_93 = Panel("Dicke Dämmschicht Massiv")
panel_94 = Panel("Dicke Luftschicht Massiv")
panel_95 = Panel("Dicke Luftschicht Holz")
panel_96 = Panel("Dicke Wand Massiv")
panel_97 = Panel("Dicke Holständer Holz")
panel_99 = Panel("Dicke Putz Holz")
data_5 = Data(dicke_außenputz)
data_6 = Data(dicke_osb_2)
data_7 = Data(dicke_gk)
addition_2 = Addition(A=data_6, B=data_7)
panel_100 = Panel("Dicke Wand Tragend")
panel_101 = Panel("Dicke Putz")
panel_102 = Panel("Dicke Abdichtung")
panel_103 = Panel("Dicke Aüßere Dämmschicht")
bool_5 = Boolean(bool_4)
bool_6 = Boolean(bool_4)
data_8 = Data(dicke_wand)
bool_7 = Boolean(bool_4)
panel_104 = Panel("Dicke Luftschicht")
data_9 = Data(dicke_innenputz_2)
data_10 = Data(dicke_abdichtung)
data_11 = Data(dicke_wand_2)
data_12 = Data(dicke_innenputz_3)
data_13 = Data(dicke_diffusionsoffene_schicht_2)
bool_8 = Boolean(bool_4)
data_14 = Data(num_22)
data_15 = Data(dicke_zweite_dämmschicht)
bool_9 = Boolean(bool_4)
data_16 = Data(panel_89)
data_17 = Data(dicke_latte_luftschicht_2)
panel_105 = Panel("Dicke Außenhaut")
panel_106 = Panel("Dicke Wandaufbau Gesamt")
bool_10 = Boolean(bool_4)
p_n_c_2 = PickNChoose(Pattern=bool_6, Stream0=data_9, Stream1=data_12)
p_n_c_3 = PickNChoose(Pattern=bool_5, Stream0=data_8, Stream1=data_11)
p_n_c_4 = PickNChoose(Pattern=bool_7, Stream0=data_10, Stream1=data_13)
p_n_c_5 = PickNChoose(Pattern=bool_8, Stream0=data_14, Stream1=data_15)
p_n_c_6 = PickNChoose(Pattern=bool_9, Stream0=data_16, Stream1=data_17)
p_n_c_7 = PickNChoose(Pattern=bool_10, Stream0=data_5, Stream1=addition_2)
data_18 = Data(p_n_c_2)
data_19 = Data(p_n_c_3)
data_20 = Data(p_n_c_4)
data_21 = Data(p_n_c_5)
data_22 = Data(p_n_c_6)
data_23 = Data(p_n_c_7)
ma = MassAddition(Input=[data_23, data_22, data_21, data_20, data_19, data_18])  # -> Result, PartialResults
data_24 = Data(ma.Result)

# ----
num_27 = Number(data_24)
rectangle_3 = Rectangle(Plane=pl, XSize=breite_tür, YSize=num_27, Radius=0)  # -> Rectangle, Length
move_12 = Move(Geometry=rectangle_3.Rectangle, Motion=multiplication_3)  # -> Geometry, Transform
num_28 = Number(num_27)
multiplication_9 = Multiplication(A=vec_2, B=num_28)
boxrec_2 = BoxRectangle(Rectangle=move_12.Geometry, Height=höhe_tür)
# Daten für Trim "Wo ist Tür"
data_25 = Data(boxrec_2)
trim_4 = TrimWithBreps(Curve=data, Brep=data_25)  # -> Inside, Outside
trim_5 = TrimWithBreps(Curve=data_4, Brep=data_25)  # -> Inside, Outside
trim_6 = TrimWithBreps(Curve=data_3, Brep=data_25)  # -> Inside, Outside
trim_7 = TrimWithBreps(Curve=data_2, Brep=data_25)  # -> Inside, Outside
crv_12 = Curve(trim_5.Outside)
crv_13 = Curve(trim_4.Outside)
crv_14 = Curve(trim_6.Outside)
crv_15 = Curve(trim_7.Outside)
fenster_generator = FensterGenerator(
    num_5=num,
    wwr_himmelsrichtung=num_11,
    kurven_himmelsrichtung=crv_12,
    num=num_27,
    pt=pt_4,
    num_2=number_slider_3,
    num_10=data_24)  # -> G, output_glas_2, output_fensterrahmen_2, B
fenster_generator_2 = FensterGenerator(
    num_5=num,
    wwr_himmelsrichtung=num_14,
    kurven_himmelsrichtung=crv_13,
    num=num_27,
    pt=pt_4,
    num_2=number_slider_3,
    num_10=data_24)  # -> G, output_glas_2, output_fensterrahmen_2, B
fenster_generator_3 = FensterGenerator(
    num_5=num,
    wwr_himmelsrichtung=num_12,
    kurven_himmelsrichtung=crv_14,
    num=num_27,
    pt=pt_4,
    num_2=number_slider_3,
    num_10=data_24)  # -> G, output_glas_2, output_fensterrahmen_2, B
fenster_generator_4 = FensterGenerator(
    num_5=num,
    wwr_himmelsrichtung=num_13,
    kurven_himmelsrichtung=crv_15,
    num=num_27,
    pt=pt_4,
    num_2=number_slider_3,
    num_10=data_24)  # -> G, output_glas_2, output_fensterrahmen_2, B
# Daten für Abzug Wand
data_26 = Data(flatten([boxrec_2, fenster_generator_3.B, fenster_generator.B, fenster_generator_2.B, fenster_generator_4.B]))
data_27 = Data([fenster_generator.G, fenster_generator_2.G, fenster_generator_3.G, fenster_generator_4.G])
null = NullItem(Item=data_27)  # -> NullFlags, InvalidFlags, Description
invbool = InvertBoolean(Boolean=null.NullFlags)  # -> Inverted, Number
cull_11 = CullPattern(List=data_27, CullPattern=invbool.Inverted)
data_28 = Data([fenster_generator.output_fensterrahmen_2, fenster_generator_2.output_fensterrahmen_2, fenster_generator_3.output_fensterrahmen_2, fenster_generator_4.output_fensterrahmen_2])
data_29 = Data([fenster_generator.output_glas_2, fenster_generator_2.output_glas_2, fenster_generator_3.output_glas_2, fenster_generator_4.output_glas_2])
data_30 = Data(data_29)
custom_preview = CustomPreview(Geometry=data_30, Material=create_material_9)
data_31 = Data(cull_11)
panel_107 = Panel(cull_11)
move_13 = Move(Geometry=move.Geometry, Motion=multiplication_9)  # -> Geometry, Transform
move_14 = Move(Geometry=move_13.Geometry, Motion=Z_3)  # -> Geometry, Transform
move_15 = Move(Geometry=move_2.Geometry, Motion=multiplication_9)  # -> Geometry, Transform
move_16 = Move(Geometry=move_15.Geometry, Motion=Z_3)  # -> Geometry, Transform
pline_2 = PolyLine(Vertices=[move_3.Geometry, move_4.Geometry, move_14.Geometry, move_16.Geometry], Closed=Toggle(True))
pline_3 = PolyLine(Vertices=[move.Geometry, move_2.Geometry, move_15.Geometry, move_13.Geometry], Closed=Toggle(True))
pline_4 = PolyLine(Vertices=[move.Geometry, move_13.Geometry, move_14.Geometry, move_4.Geometry], Closed=Toggle(True))
pline_5 = PolyLine(Vertices=[move_15.Geometry, move_2.Geometry, move_3.Geometry, move_16.Geometry], Closed=Toggle(True))
fpatch_2 = FragmentPatch(Boundary=pline_2)
fpatch_3 = FragmentPatch(Boundary=pline_3)
fpatch_4 = FragmentPatch(Boundary=pline_4)
fpatch_5 = FragmentPatch(Boundary=pline_5)
join_7 = BrepJoin(Breps=[fpatch_2, fpatch_4, fpatch_5])  # -> Breps, Closed
offsetbrep_3 = OffsetBrep(Brep=join_7.Breps, OffsetDistance=neg, Solid=Toggle(True), SharpEdges=True, Tolerance=0.01)
extr_6 = Extrude(Base=fpatch_3, Direction=Z_5)
data_32 = Data([offsetbrep_3, extr_6])
num_29 = Number(num_27)
multiplication_10 = Multiplication(A=num_29, B=Slider(0.7, range=0..1))
multiplication_11 = Multiplication(A=vec_7, B=multiplication_10)
move_17 = Move(Geometry=fpatch, Motion=multiplication_11)  # -> Geometry, Transform
evalsrf_4 = EvaluateSurface(Surface=reparameterize(move_17.Geometry), Point=md_slider_4)  # -> Point, Normal, UDirection, VDirection, Frame
offsrf = OffsetSurface(Surface=move_17.Geometry, Distance=Slider(0.04, range=0..0.1), BothSides=0, CreateSolid=True)
pl_3 = ConstructPlane(Origin=evalsrf_4.Point, XAxis=evalsrf_4.VDirection, YAxis=evalsrf_4.UDirection)
data_33 = Data(offsrf)
cyl = Cylinder(Base=pl_3, Radius=number_slider_4, Length=number_slider_4)
multiplication_12 = Multiplication(A=evalsrf_4.Normal, B=neg_2)
move_18 = Move(Geometry=evalsrf_4.Point, Motion=multiplication_12)  # -> Geometry, Transform
sph_2 = Sphere(Base=move_18.Geometry, Radius=number_slider_4)
data_34 = Data([sph_2, cyl, data_32])
panel_108 = Panel("Kurve Dämmung")
panel_109 = Panel("""Kurve Dämmung
Hochgeschoben Ringbalken""")
# Grundriss nach Zweiter Dämmschicht
panel_110 = Panel("Dicke Latte Luftschicht")
höhe_ringbalken_unten = Slider(0.2, range=0..1)
panel_111 = Panel("Ringbalken Holz unten")
panel_113 = Panel("Grundriss Ganz innen")
# Raumhöhe x 10 um Cutoff zu generieren
num_30 = Number(raumhöhe_4)
panel_115 = Panel("Grundriss nach Dämmung")
panel_116 = Panel("Grundriss nach Abdichtung")
panel_118 = Panel("Grundriss nach OSB")
panel_119 = Panel("Y Holzständer")
num_31 = Number(dicke_latte_luftschicht_2)
multiplication_13 = Multiplication(B="10")
panel_120 = Panel("Dicke Innenputz")
# Grundriss nach tragender Wand
# Raumhöhe x 10 um Cutoff zu generieren
panel_121 = Panel("Dicke Diff Schicht")
num_32 = Number(raumhöhe_4)
crv_16 = Curve(grundriss)
crv_17 = Curve(crv_11)
# Raumhöhe x 10 um Cutoff zu generieren
num_33 = Number(raumhöhe_4)
# Raumhöhe x 10 um Cutoff zu generieren
panel_123 = Panel("Dicke Außenputz")
num_34 = Number(raumhöhe_4)
# Raumhöhe x 10 um Cutoff zu generieren
panel_124 = Panel("Dicke Zweite Dämmschicht")
# Raumhöhe x 10 um Cutoff zu generieren
panel_125 = Panel("Dicke Dämmung")
# Raumhöhe x 10 um Cutoff zu generieren
panel_126 = Panel("Dicke OSB")
# Grundriss nach tragender Wand
# Raumhöhe x 10 um Cutoff zu generieren
panel_127 = Panel("Dicke Abdichtung")
num_35 = Number(raumhöhe_4)
Z_10 = UnitZ(Factor=multiplication_13)
Z_11 = UnitZ(Factor=num_32)
num_36 = Number(raumhöhe_4)
Z_12 = UnitZ(Factor=1)
panel_128 = Panel("Innenputz")
multiplication_14 = Multiplication(B="10")
num_37 = Number(raumhöhe_4)
Z_13 = UnitZ(Factor=1)
num_38 = Number(raumhöhe_4)
offset_2 = OffsetCurve(Curve=crv_16, Distance=dicke_innenputz_3, Corners=1)
edges_3 = BrepEdges(Brep=offset_2)  # -> Naked, Interior, NonManifold
len_4 = Length(Curve=edges_3.Naked)
crv_18 = Curve(offset_2)
divide = DivideCurve(Curve=edges_3.Naked, Count=len_4, Kinks=False)  # -> Points, Tangents, Parameters
offset_3 = OffsetCurve(Curve=crv_18, Distance=dicke_wand_2, Corners=1)
crv_19 = Curve(offset_3)
panel_131 = Panel("Kurve OSB")
offset_4 = OffsetCurve(Curve=crv_19, Distance=dicke_diffusionsoffene_schicht_2, Corners=1)
crv_20 = Curve(offset_4)
offset_5 = OffsetCurve(Curve=crv_17, Distance=dicke_innenputz_2, Corners=1)
multiplication_15 = Multiplication(B="10")
num_39 = Number(raumhöhe_4)
panel_132 = Panel("Außenputz")
panel_133 = Panel("Zweite Dämmschicht")
multiplication_16 = Multiplication(B="10")
panel_135 = Panel("Grundriss nach Inneputz")
dicke_fußbodendämmung = Slider(0.12, range=0.12..0.25)
offset_6 = OffsetCurve(Curve=crv_20, Distance=dicke_zweite_dämmschicht, Corners=1)
crv_21 = Curve(offset_6)
offset_7 = OffsetCurve(Curve=crv_21, Distance=num_31, Corners=1)
multiplication_17 = Multiplication(B="10")
multiplication_18 = Multiplication(B="10")
multiplication_19 = Multiplication(B="10")
dispatch_8 = Dispatch(List=Z_10, DispatchPattern=bool_3)  # -> ListA, ListB
dispatch_9 = Dispatch(List=Z_11, DispatchPattern=bool_3)  # -> ListA, ListB
# Randkure Innenputz
# für Bodenbelag beginn
dicke_bodenbelag = Slider(0.05, range=0..0.1)
multiplication_20 = Multiplication(B="10")
dicke_estrich = Slider(0.08, range=0.025..0.1)
num_40 = Number(raumhöhe_4)
dicke_dampfsperre = Slider(0.01, range=0.005..0.01)
dicke_bodenplatte = Slider(0.3, range=0.25..0.5)
edges_4 = BrepEdges(Brep=offset_7)  # -> Naked, Interior, NonManifold
boundary = BoundarySurfaces(Edges=flatten([crv_18, offset_3]))
num_41 = Number(raumhöhe_4)
Z_14 = UnitZ(Factor=multiplication_15)
boundary_2 = BoundarySurfaces(Edges=flatten([crv_16, offset_2]))
boundary_3 = BoundarySurfaces(Edges=flatten([crv_19, offset_4]))
boundary_4 = BoundarySurfaces(Edges=flatten([crv_17, offset_5]))
num_42 = Number(raumhöhe_4)
Z_15 = UnitZ(Factor=multiplication_16)
Z_16 = UnitZ(Factor=höhe_ringbalken_unten)
Z_17 = UnitZ(Factor=multiplication_14)
Z_18 = UnitZ(Factor=multiplication_17)
Z_19 = UnitZ(Factor=multiplication_18)
# Raumhöhe x 10 um Cutoff zu generieren
panel_145 = Panel("Dicke Wand")
panel_146 = Panel("Dicke OSB")
Z_20 = UnitZ(Factor=multiplication_20)
Z_21 = UnitZ(Factor=num_40)
boundary_5 = BoundarySurfaces(Edges=flatten([crv_20, offset_6]))
crv_22 = Curve(offset_5)
# Grundriss vor tragender Wand
edges_5 = BrepEdges(Brep=crv_22)  # -> Naked, Interior, NonManifold
midpt_3 = CurveMiddle(Curve=edges_5.Naked)
line = LineSDL(Start=midpt_3, Direction=Z_12, Length=Slider(100000000, range=0..100000000))
Z_22 = UnitZ(Factor=raumhöhe_3)
Z_23 = UnitZ(Factor=multiplication_19)
Z_24 = UnitZ(Factor=num_41)
crv_23 = Curve(offset_2)
# Raumhöhe x 10 um Cutoff zu generieren
num_43 = Number(raumhöhe_4)
Z_25 = UnitZ(Factor=num_42)
item = ListItem(List=divide.Points, Index="0", Wrap=True)
dispatch_10 = Dispatch(List=Z_14, DispatchPattern=bool_3)  # -> ListA, ListB
num_44 = Number(raumhöhe_4)
panel_150 = Panel("Tragende Wand")
Z_26 = UnitZ(Factor=1)
midpt_4 = CurveMiddle(Curve=edges_4.Naked)
dispatch_11 = Dispatch(List=Z_15, DispatchPattern=bool_3)  # -> ListA, ListB
extr_7 = Extrude(Base=boundary, Direction=Z_16)
dispatch_12 = Dispatch(List=Z_18, DispatchPattern=bool_3)  # -> ListA, ListB
dispatch_13 = Dispatch(List=Z_21, DispatchPattern=bool_3)  # -> ListA, ListB
panel_157 = Panel("Gipskarton")
offset_8 = OffsetCurve(Curve=crv_22, Distance=dicke_wand, Corners=1)
# Grundriss nach tragender Wand
edges_6 = BrepEdges(Brep=offset_8)  # -> Naked, Interior, NonManifold
midpt_5 = CurveMiddle(Curve=edges_6.Naked)
crv_24 = Curve(offset_8)
offset_9 = OffsetCurve(Curve=crv_24, Distance=dicke_abdichtung, Corners=1)
crv_25 = Curve(offset_9)
offset_10 = OffsetCurve(Curve=crv_25, Distance=num_22, Corners=1)
crv_26 = Curve(offset_10)
offset_11 = OffsetCurve(Curve=crv_26, Distance=dicke_außenputz, Corners=1)
line_2 = LineSDL(Start=midpt_5, Direction=Z_13, Length=Slider(100000000, range=0..100000000))
boundary_6 = BoundarySurfaces(Edges=flatten([crv_26, offset_11]))
boundary_7 = BoundarySurfaces(Edges=flatten([crv_25, offset_10]))
boundary_8 = BoundarySurfaces(Edges=flatten([crv_24, offset_9]))
item_2 = ListItem(List=divide.Points, Index="0", Wrap=True)
item_3 = ListItem(List=divide.Tangents, Index="0", Wrap=True)
offset_12 = OffsetCurve(Curve=offset_7, Distance=dicke_osb_2, Corners=1)
crv_27 = Curve(offset_12)
offset_13 = OffsetCurve(Curve=crv_27, Distance=dicke_gk, Corners=1)
boundary_9 = BoundarySurfaces(Edges=flatten([crv_27, offset_13]))
multiplication_21 = Multiplication(B="10")
dispatch_14 = Dispatch(List=Z_23, DispatchPattern=bool_3)  # -> ListA, ListB
dispatch_15 = Dispatch(List=Z_19, DispatchPattern=bool_3)  # -> ListA, ListB
multiplication_22 = Multiplication(B="10")
dispatch_16 = Dispatch(List=Z_24, DispatchPattern=bool_3)  # -> ListA, ListB
dispatch_17 = Dispatch(List=Z_20, DispatchPattern=bool_3)  # -> ListA, ListB
dispatch_18 = Dispatch(List=Z_25, DispatchPattern=bool_3)  # -> ListA, ListB
panel_165 = Panel("Breite Latte")
move_19 = Move(Geometry=crv_23, Motion=Z_22)  # -> Geometry, Transform
dist = Distance(PointA=item, PointB=divide.Points)
panel_168 = Panel("Tür Rechteck")
extr_8 = Extrude(Base=boundary_4, Direction=dispatch_8.ListB)
Z_27 = UnitZ(Factor=multiplication_21)
extr_9 = Extrude(Base=boundary_4, Direction=dispatch_9.ListA)
line_3 = LineSDL(Start=midpt_4, Direction=Z_26, Length=Slider(100000000, range=0..100000000))
align = AlignPlane(Plane=item_2, Direction=item_3)  # -> Plane, Angle
boundary_10 = BoundarySurfaces(Edges=flatten([crv_22, offset_8]))
boundary_11 = BoundarySurfaces(Edges=flatten([offset_7, offset_12]))
breite_der_latte = Number(num_26)
bnd_5 = Bounds(Numbers=dist)
fastsdiff = FastSolidDifference(
    SubtractFrom=graft(extr_7),
    SubtractWith=data_26,
    Tolerance=0.01,
    computeBBFastSolidDiff=True,
    retainFastSolidDiff=True,
    strictFastSolidDiff=True,
    trueIntFastSolidDiff=False)
extr_10 = Extrude(Base=boundary_3, Direction=dispatch_10.ListB)
num_45 = Number(raumhöhe_3)
num_46 = Number(raumhöhe_3)
extr_11 = Extrude(Base=boundary_8, Direction=dispatch_15.ListB)
dispatch_19 = Dispatch(List=Z_27, DispatchPattern=bool_3)  # -> ListA, ListB
extr_12 = Extrude(Base=boundary_7, Direction=dispatch_17.ListB)
extr_13 = Extrude(Base=boundary_6, Direction=dispatch_11.ListB)
num_47 = Number(raumhöhe_3)
num_48 = Number(raumhöhe_3)
Z_28 = UnitZ(Factor=num_45)
num_49 = Number(raumhöhe_4)
extr_14 = Extrude(Base=boundary_9, Direction=dispatch_14.ListB)
Z_29 = UnitZ(Factor=num_46)
dedom2num = DeconstructDomain²(Domain=bnd_5)  # -> UMin, UMax, VMin, VMax
extr_15 = Extrude(Base=boundary_5, Direction=dispatch_12.ListB)

extr_16 = Extrude(Base=boundary_6, Direction=dispatch_13.ListA)
fastsdiff_2 = FastSolidDifference(
    SubtractFrom=graft(extr_16),
    SubtractWith=data_26,
    Tolerance=0.01,
    computeBBFastSolidDiff=True,
    retainFastSolidDiff=True,
    strictFastSolidDiff=True,
    trueIntFastSolidDiff=False)

incidentradiation = LBIncidentRadiation(
    sky_mtx=skymatrix.sky_mtx,
    geometry=flatten(data_31),
    context=flatten(fastsdiff_2),
    grid_size=number_slider,
    run=toggle_2)  # -> report, points, results, total, mesh, legend, title, int_mtx; disabled; plug-in component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
panel_181 = Panel(incidentradiation.results)  # disabled
panel_182 = Panel(incidentradiation.total)  # disabled
Z_30 = UnitZ(Factor=num_47)
Z_31 = UnitZ(Factor=num_48)
fastsdiff_3 = FastSolidDifference(
    SubtractFrom=graft(extr_9),
    SubtractWith=data_26,
    Tolerance=0.01,
    computeBBFastSolidDiff=True,
    retainFastSolidDiff=True,
    strictFastSolidDiff=True,
    trueIntFastSolidDiff=False)
extr_17 = Extrude(Base=boundary_8, Direction=dispatch_16.ListA)
Z_32 = UnitZ(Factor=höhe_ringbalken_unten)
extr_18 = Extrude(Base=boundary_7, Direction=dispatch_18.ListA)
Z_33 = UnitZ(Factor=num_49)
panel_186 = Panel("X Holzständer")
dispatch_20 = Dispatch(List=Z_28, DispatchPattern=bool_3)  # -> ListA, ListB
dispatch_21 = Dispatch(List=Z_17, DispatchPattern=bool_3)  # -> ListA, ListB
dispatch_22 = Dispatch(List=Z_29, DispatchPattern=bool_3)  # -> ListA, ListB
dispatch_23 = Dispatch(List=Z_30, DispatchPattern=bool_3)  # -> ListA, ListB
dispatch_24 = Dispatch(List=Z_31, DispatchPattern=bool_3)  # -> ListA, ListB
subtraction_3 = Subtraction(A=dedom2num.UMax, B=breite_der_latte)
move_20 = Move(Geometry=crv_18, Motion=Z_32)  # -> Geometry, Transform
edges_7 = BrepEdges(Brep=move_20.Geometry)  # -> Naked, Interior, NonManifold
len_5 = Length(Curve=edges_7.Naked)
divide_2 = DivideCurve(Curve=edges_7.Naked, Count=len_5, Kinks=False)  # -> Points, Tangents, Parameters
item_4 = ListItem(List=divide_2.Points, Index="0", Wrap=True)
item_5 = ListItem(List=divide_2.Tangents, Index="0", Wrap=True)
item_6 = ListItem(List=divide_2.Points, Index="0", Wrap=True)
align_2 = AlignPlane(Plane=item_4, Direction=item_5)  # -> Plane, Angle
dist_2 = Distance(PointA=item_6, PointB=divide_2.Points)
bnd_6 = Bounds(Numbers=dist_2)
dispatch_25 = Dispatch(List=Z_33, DispatchPattern=bool_3)  # -> ListA, ListB
num_50 = Number(raumhöhe_3)
dedom2num_2 = DeconstructDomain²(Domain=bnd_6)  # -> UMin, UMax, VMin, VMax
extr_19 = Extrude(Base=boundary_11, Direction=dispatch_19.ListB)
num_51 = Number(num_26)
extr_20 = Extrude(Base=boundary_2, Direction=dispatch_21.ListB)

fastsdiff_4 = FastSolidDifference(
    SubtractFrom=graft(extr_18),
    SubtractWith=data_26,
    Tolerance=0.01,
    computeBBFastSolidDiff=True,
    retainFastSolidDiff=True,
    strictFastSolidDiff=True,
    trueIntFastSolidDiff=False)

extr_21 = Extrude(Base=boundary_3, Direction=dispatch_20.ListA)
data_35 = Data(fastsdiff)
panel_204 = Panel("Dicke Latte Luftschicht")
dom_3 = ConstructDomain(DomainStart=0, DomainEnd=subtraction_3)
Z_34 = UnitZ(Factor=1)
Z_35 = UnitZ(Factor=num_50)
Z_36 = UnitZ(Factor=1)
extr_22 = Extrude(Base=boundary_2, Direction=dispatch_22.ListA)
fastsdiff_5 = FastSolidDifference(
    SubtractFrom=graft(extr_17),
    SubtractWith=data_26,
    Tolerance=0.01,
    computeBBFastSolidDiff=True,
    retainFastSolidDiff=True,
    strictFastSolidDiff=True,
    trueIntFastSolidDiff=False)
extr_23 = Extrude(Base=boundary_5, Direction=dispatch_23.ListA)
extr_24 = Extrude(Base=boundary_9, Direction=dispatch_24.ListA)
subtraction_4 = Subtraction(A=dedom2num_2.UMax, B=num_51)
dispatch_26 = Dispatch(List=Z_35, DispatchPattern=bool_3)  # -> ListA, ListB
Z_37 = UnitZ(Factor=dicke_bodenbelag)
Z_38 = UnitZ(Factor=dicke_estrich)
rectangle_4 = Rectangle(Plane=align.Plane, XSize=breite_der_latte, YSize=dicke_latte_luftschicht, Radius=0)  # -> Rectangle, Length
Z_39 = UnitZ(Factor=dicke_fußbodendämmung)
Z_40 = UnitZ(Factor=dicke_dampfsperre)
Z_41 = UnitZ(Factor=dicke_bodenplatte)
fastsdiff_6 = FastSolidDifference(
    SubtractFrom=graft(extr_21),
    SubtractWith=data_26,
    Tolerance=0.01,
    computeBBFastSolidDiff=True,
    retainFastSolidDiff=True,
    strictFastSolidDiff=True,
    trueIntFastSolidDiff=False)
remap_2 = RemapNumbers(Value=dist, Source=bnd_5, Target=dom_3)  # -> Mapped, Clipped
crv_28 = Curve(move_20.Geometry)
# Grundriss vor tragender Wand
edges_8 = BrepEdges(Brep=crv_28)  # -> Naked, Interior, NonManifold
midpt_6 = CurveMiddle(Curve=edges_8.Naked)
line_4 = LineSDL(Start=midpt_6, Direction=Z_34, Length=Slider(100000000, range=0..100000000))
# Frostsicheres Fundament mind 80cm
panel_219 = Panel("Dicke Wand")
dom_4 = ConstructDomain(DomainStart=0, DomainEnd=subtraction_4)
neg_3 = Negative(Value=Z_37)
neg_4 = Negative(Value=Z_38)
neg_5 = Negative(Value=Z_39)
neg_6 = Negative(Value=Z_40)
neg_7 = Negative(Value=Z_41)
multiplication_23 = Multiplication(A=remap_2.Mapped, B=item_3)
ma_2 = MassAddition(Input=[dicke_bodenbelag, dicke_estrich, dicke_fußbodendämmung, dicke_dampfsperre, dicke_bodenplatte])  # -> Result, PartialResults
panel_224 = Panel("Dicke Diffusionsoffene Schicht")
extr_25 = Extrude(Base=boundary_11, Direction=dispatch_26.ListA)
fastsdiff_7 = FastSolidDifference(
    SubtractFrom=graft(extr_24),
    SubtractWith=data_26,
    Tolerance=0.01,
    computeBBFastSolidDiff=True,
    retainFastSolidDiff=True,
    strictFastSolidDiff=True,
    trueIntFastSolidDiff=False)
offset_14 = OffsetCurve(Curve=crv_28, Distance=dicke_wand_2, Corners=1)
# Grundriss nach tragender Wand
edges_9 = BrepEdges(Brep=offset_14)  # -> Naked, Interior, NonManifold
midpt_7 = CurveMiddle(Curve=edges_9.Naked)
line_5 = LineSDL(Start=midpt_7, Direction=Z_36, Length=Slider(100000000, range=0..100000000))
fastsdiff_8 = FastSolidDifference(
    SubtractFrom=graft(extr_22),
    SubtractWith=data_26,
    Tolerance=0.01,
    computeBBFastSolidDiff=True,
    retainFastSolidDiff=True,
    strictFastSolidDiff=True,
    trueIntFastSolidDiff=False)
fastsdiff_9 = FastSolidDifference(
    SubtractFrom=graft(extr_23),
    SubtractWith=data_26,
    Tolerance=0.01,
    computeBBFastSolidDiff=True,
    retainFastSolidDiff=True,
    strictFastSolidDiff=True,
    trueIntFastSolidDiff=False)
move_21 = Move(Geometry=rectangle_4.Rectangle, Motion=multiplication_23)  # -> Geometry, Transform
rad_2 = Radians(Degrees="90")
vec_8 = Vector(divide.Tangents)
rectangle_5 = Rectangle(Plane=align_2.Plane, XSize=num_51, YSize=dicke_wand_2, Radius=0)  # -> Rectangle, Length
panel_229 = Panel("Dämmdicke CSV")
panel_231 = Panel("Output Data Abdichtung")
remap_3 = RemapNumbers(Value=dist_2, Source=bnd_6, Target=dom_4)  # -> Mapped, Clipped
num_52 = Number(data_19)
boundary_12 = BoundarySurfaces(Edges=flatten([crv_28, offset_14]))
panel_234 = Panel("Output Data Beton")
panel_235 = Panel("Output Data Außenwand")
rotate_2 = Rotate(Geometry=vec_8, Angle=rad_2, Plane=PlaneXY(0, 0, 0))  # -> Geometry, Transform
panel_236 = Panel("Output Data Dichtung")
fastsdiff_10 = FastSolidDifference(
    SubtractFrom=graft(extr_25),
    SubtractWith=data_26,
    Tolerance=0.01,
    computeBBFastSolidDiff=True,
    retainFastSolidDiff=True,
    strictFastSolidDiff=True,
    trueIntFastSolidDiff=False)
num_53 = Number(num_22)
panel_238 = Panel("Output Data Dämmung")
addition_3 = Addition(A=dicke_diffusionsoffene_schicht_2, B=dicke_wand_2)
smaller_6 = SmallerThan(FirstNumber=num_53, SecondNumber="0")  # -> SmallerThan, OrEqualTo
multiplication_24 = Multiplication(A=remap_3.Mapped, B=item_5)
panel_241 = Panel("Höhe Ringbalken Unten")
neg_8 = Negative(Value="0.8")
panel_244 = Panel("Logik Dämmstärke = 0")
panel_245 = Panel("Dicke zweite Dämmschicht")
num_54 = Number(raumhöhe_3)
move_22 = Move(Geometry=rectangle_5.Rectangle, Motion=multiplication_24)  # -> Geometry, Transform
panel_247 = Panel("Höhe Attika")
num_55 = Number(raumhöhe_3)
Z_42 = UnitZ(Factor=neg_8)
addition_4 = Addition(A=dicke_zweite_dämmschicht, B=addition_3)
subtraction_5 = Subtraction(A=num_54, B=höhe_ringbalken_unten)
num_56 = Number(raumhöhe_3)
subtraction_6 = Subtraction(A=num_55, B=höhe_ringbalken_unten)

# ----
# Summe aus allen Bauteilen nach Wand bilden
num_57 = Number(data_21)
num_58 = Number(data_22)
num_59 = Number(data_20)
num_60 = Number(data_23)

Z_43 = UnitZ(Factor=subtraction_5)
multiplication_25 = Multiplication(A=rotate_2.Geometry, B=addition_4)
Z_44 = UnitZ(Factor=subtraction_6)
dispatch_27 = Dispatch(List=Z_43, DispatchPattern=bool_3)  # -> ListA, ListB
dispatch_28 = Dispatch(List=Z_44, DispatchPattern=bool_3)  # -> ListA, ListB
subtraction_7 = Subtraction(A="0.8", B=ma_2.Result)
move_23 = Move(Geometry=move_21.Geometry, Motion=multiplication_25)  # -> Geometry, Transform
extr_26 = Extrude(Base=boundary_12, Direction=dispatch_27.ListA)
ma_3 = MassAddition(Input=[num_59, num_57, num_58, num_60])  # -> Result, PartialResults
extr_27 = Extrude(Base=move_22.Geometry, Direction=dispatch_28.ListA)
panel_264 = Panel("Kurve Abdichtung Außen")
panel_265 = Panel("Kurve Abdichtung")
panel_267 = Panel("Dicke Dämmung")
panel_268 = Panel("Kurve Putz")
cap = CapHoles(Brep=extr_27)
num_61 = Number(data_23)
num_62 = Number(data_22)
# Mass Addition Dicke Bodenaufbau
num_63 = Number(data_20)
fastsdiff_11 = FastSolidDifference(
    SubtractFrom=graft(cap),
    SubtractWith=data_26,
    Tolerance=0.01,
    UseTasks=True,
    computeBBFastSolidDiff=True,
    retainFastSolidDiff=True,
    strictFastSolidDiff=True,
    trueIntFastSolidDiff=False)
# Mass Addition Dicke Bodenaufbau
num_64 = Number(data_23)
# Mass Addition Dicke Bodenaufbau
num_65 = Number(data_21)
# Mass Addition Dicke Bodenaufbau
addition_5 = Addition(A=num_61, B=num_62)
fastsdiff_12 = FastSolidDifference(
    SubtractFrom=graft(extr_26),
    SubtractWith=data_26,
    Tolerance=0.01,
    computeBBFastSolidDiff=True,
    retainFastSolidDiff=True,
    strictFastSolidDiff=True,
    trueIntFastSolidDiff=False)
neg_9 = Negative(Value=ma_2.Result)
neg_10 = Negative(Value=ma_2.Result)
neg_11 = Negative(Value=ma_2.Result)
Z_45 = UnitZ(Factor=subtraction_7)
neg_12 = Negative(Value=ma_2.Result)
Z_46 = UnitZ(Factor=neg_9)
Z_47 = UnitZ(Factor=neg_10)
Z_48 = UnitZ(Factor=neg_11)
Z_49 = UnitZ(Factor=neg_12)
panel_283 = Panel("Logik Holzbau Wechsel")
num_66 = Number(num_22)
panel_284 = Panel("Oben -> Holzbau")
smaller_7 = SmallerThan(FirstNumber=num_66, SecondNumber="0")  # -> SmallerThan, OrEqualTo
panel_292 = Panel("Kurve Massiv")
panel_293 = Panel("Kurve Holz")

# ---- group: Logik Wand Kurven
# Boolean Switch Holz Stein
# Boolean Switch Holz Stein
# Boolean Switch Holz Stein
# Boolean Switch Holz Stein
# Boolean Switch Holz Stein
panel_296 = Panel("Kurve Massiv")
crv_29 = Curve(flip_2.Curve)
panel_302 = Panel("Innenkurve Abdichtung")
panel_303 = Panel("Innenkurve Wand")
panel_304 = Panel("Innenkurve Dämmung")
panel_305 = Panel("Innenkurve Putz")
bool_11 = Boolean(bool_4)
offset_15 = OffsetCurve(Curve=crv_29, Distance=data_24, Corners=1)
bool_12 = Boolean(bool_4)
data_36 = Data(offset_8)
bool_13 = Boolean(bool_4)
data_37 = Data(offset_5)
data_38 = Data(offset_3)
data_39 = Data(offset_9)
data_40 = Data(offset_2)
panel_306 = Panel("Außenkurve Rand")
data_41 = Data(offset_4)
bool_14 = Boolean(bool_4)
data_42 = Data(offset_10)
data_43 = Data(offset_7)
bool_15 = Boolean(bool_4)
data_44 = Data(offset_11)
data_45 = Data(offset_13)
p_n_c_8 = PickNChoose(Pattern=bool_12, Stream0=data_37, Stream1=data_40)
p_n_c_9 = PickNChoose(Pattern=bool_11, Stream0=data_36, Stream1=data_38)
p_n_c_10 = PickNChoose(Pattern=bool_13, Stream0=data_39, Stream1=data_41)
p_n_c_11 = PickNChoose(Pattern=bool_15, Stream0=data_44, Stream1=data_45)
p_n_c_12 = PickNChoose(Pattern=bool_14, Stream0=data_42, Stream1=data_43)
data_46 = Data(p_n_c_8)
data_47 = Data(p_n_c_9)
data_48 = Data(p_n_c_10)
data_49 = Data(p_n_c_12)
data_50 = Data(offset_15)

# ----
crv_30 = Curve(data_50)  # disabled
crv_31 = Curve(data_46)
fpatch_6 = FragmentPatch(Boundary=crv_31)
crv_32 = Curve(crv_31)
move_24 = Move(Geometry=fpatch_6, Motion=neg_3)  # -> Geometry, Transform
srf_2 = Surface(move_24.Geometry)
move_25 = Move(Geometry=srf_2, Motion=neg_4)  # -> Geometry, Transform
srf_3 = Surface(move_25.Geometry)
extr_28 = Extrude(Base=fpatch_6, Direction=neg_3)
extr_29 = Extrude(Base=srf_2, Direction=neg_4)
move_26 = Move(Geometry=srf_3, Motion=neg_5)  # -> Geometry, Transform
srf_4 = Surface(move_26.Geometry)
extr_30 = Extrude(Base=srf_3, Direction=neg_5)
move_27 = Move(Geometry=srf_4, Motion=neg_6)  # -> Geometry, Transform
srf_5 = Surface(move_27.Geometry)
move_28 = Move(Geometry=srf_5, Motion=neg_7)  # -> Geometry, Transform
extr_31 = Extrude(Base=srf_4, Direction=neg_6)
extr_32 = Extrude(Base=srf_5, Direction=neg_7)
offset_16 = OffsetCurve(Curve=crv_32, Distance=num_52, Corners=1)
boundary_13 = BoundarySurfaces(Edges=flatten([crv_32, offset_16]))

panel_307 = Panel("Dampfsperre")
panel_308 = Panel("Bodenplatte")
panel_309 = Panel("Fußbodendämmung")
panel_310 = Panel("Bodenbelag")
panel_311 = Panel("Estrich")
data_51 = Data(extr_28)
data_52 = Data(extr_29)
data_53 = Data(extr_31)
data_54 = Data(extr_32)
data_55 = Data(extr_30)

extr_33 = Extrude(Base=boundary_13, Direction=Z_42)
data_56 = Data(extr_33)
move_29 = Move(Geometry=offset_16, Motion=Z_42)  # -> Geometry, Transform
offset_17 = OffsetCurve(Curve=move_29.Geometry, Distance=ma_3.Result, Corners=1)
crv_33 = Curve(data_47)
crv_34 = Curve(data_48)
crv_35 = Curve(data_49)
crv_36 = Curve(data_49)
offset_18 = OffsetCurve(Curve=crv_33, Distance=num_63, Corners=1)
offset_19 = OffsetCurve(Curve=crv_34, Distance=num_65, Corners=1)
offset_20 = OffsetCurve(Curve=crv_35, Distance=num_64, Corners=1)
boundary_14 = BoundarySurfaces(Edges=flatten([offset_17, move_29.Geometry]))
offset_21 = OffsetCurve(Curve=crv_36, Distance=addition_5, Corners=1)
boundary_15 = BoundarySurfaces(Edges=flatten([crv_33, offset_18]))
boundary_16 = BoundarySurfaces(Edges=flatten([crv_34, offset_19]))
boundary_17 = BoundarySurfaces(Edges=flatten([crv_35, offset_20]))
boundary_18 = BoundarySurfaces(Edges=flatten([crv_36, offset_21]))
extr_34 = Extrude(Base=boundary_14, Direction=Z_45)
extr_35 = Extrude(Base=boundary_15, Direction=Z_46)
extr_36 = Extrude(Base=boundary_16, Direction=Z_47)
extr_37 = Extrude(Base=boundary_17, Direction=Z_48)
extr_38 = Extrude(Base=boundary_18, Direction=Z_49)
dispatch_29 = Dispatch(List=extr_37, DispatchPattern=bool_4)  # -> ListA, ListB
dispatch_30 = Dispatch(List=extr_38, DispatchPattern=bool_4)  # -> ListA, ListB
data_57 = Data(extr_35)
data_58 = Data([extr_34, data_56])
data_59 = Data(extr_36)
dispatch_31 = Dispatch(List=data_59, DispatchPattern=smaller_7.OrEqualTo)  # -> ListA, ListB
data_60 = Data([dispatch_30.ListB, dispatch_29.ListA])
data_61 = Data(dispatch_31.ListB)
num_67 = Number(num)
dicke_betondecke = Slider(0.2, range=0.07..0.25)
dicke_dampfsperre_2 = Slider(0.011, range=0.011..0.02)
dicke_dämmung = Slider(0.1, range=0..0.25)
überstand_attika = Slider(0.3, range=0.3..0.5)
ma_4 = MassAddition(Input=[dicke_betondecke, dicke_dampfsperre_2, dicke_dämmung, überstand_attika, data_20])  # -> Result, PartialResults
höhe_attika = Number(ma_4.Result)
num_68 = Number(höhe_attika)
ma_5 = MassAddition(Input=[num_56, num_68])  # -> Result, PartialResults
dispatch_32 = Dispatch(List=ma_5.Result, DispatchPattern=bool_3)  # -> ListA, ListB
Z_50 = UnitZ(Factor=dispatch_32.ListA)
extr_39 = Extrude(Base=move_23.Geometry, Direction=Z_50)
cap_2 = CapHoles(Brep=extr_39)
fastsdiff_13 = FastSolidDifference(
    SubtractFrom=graft(cap_2),
    SubtractWith=data_26,
    Tolerance=0.01,
    computeBBFastSolidDiff=True,
    retainFastSolidDiff=True,
    strictFastSolidDiff=True,
    trueIntFastSolidDiff=False)
data_62 = Data(fastsdiff_13)

# ---- group: Dach Grundform
data_63 = Data(data_50)
dispatch_33 = Dispatch(List=data_63, DispatchPattern=bool_3)  # -> ListA, ListB
crv_37 = Curve(flatten(dispatch_33.ListB))
panel_314 = Panel("Dachüberstand")
offset_22 = OffsetCurve(Curve=crv_37, Distance=num_5, Corners=1)
Z_51 = UnitZ(Factor=num)
move_30 = Move(Geometry=crv_37, Motion=Z_51)  # -> Geometry, Transform
move_31 = Move(Geometry=offset_22, Motion=Z_51)  # -> Geometry, Transform
roof = ModelRoof(Curve=move_31.Geometry, Angle=Slider(30, range=5..89), indexSize=1, showIndices=False)
join_8 = BrepJoin(Breps=roof)  # -> Breps, Closed

# ----
panel_316 = Panel("Dicke Aufbau Attika")

# ---- group: Holz Attika
# Nur Aktiv wenn Holz Aktiv
# Raumhöhe - Höhe Ringbalken Unten
panel_317 = Panel("Höhe Attika")
num_69 = Number(höhe_attika)
panel_318 = Panel("Höhe Deckenplatte")
dicke_abschlussbrett = Slider(0.03, range=0..0.1)
subtraction_8 = Subtraction(A=num_69, B=dicke_betondecke)
panel_320 = Panel("Dicke Abschlussbrett")
panel_323 = Panel("Kuve Dämmung Oben")
addition_6 = Addition(A=num_67, B=dicke_betondecke)
rectangle_6 = Rectangle(Plane=PlaneXY(0, 0, 0), XSize=dicke_wand_2, YSize=dicke_abschlussbrett, Radius=0)  # -> Rectangle, Length
subtraction_9 = Subtraction(A=subtraction_8, B=dicke_abschlussbrett)
crv_38 = Curve(move_19.Geometry)
dispatch_34 = Dispatch(List=data_46, DispatchPattern=bool_3)  # -> ListA, ListB
Z_52 = UnitZ(Factor=addition_6)
dispatch_35 = Dispatch(List=move_22.Geometry, DispatchPattern=bool_4)  # -> ListA, ListB
num_70 = Number(data_19)
dispatch_36 = Dispatch(List=crv_38, DispatchPattern=bool_3)  # -> ListA, ListB
move_32 = Move(Geometry=dispatch_34.ListA, Motion=Z_52)  # -> Geometry, Transform
dispatch_37 = Dispatch(List=dispatch_35.ListA, DispatchPattern=bool_3)  # -> ListA, ListB
num_71 = Number(höhe_attika)
num_72 = Number()
Z_53 = UnitZ(Factor=num_71)
rectangle_7 = Rectangle(Plane=PlaneXY(0, 0, 0), XSize=subtraction_9, YSize=num_70, Radius=0)  # -> Rectangle, Length
Z_54 = UnitZ(Factor=num_72)
move_33 = Move(Geometry=dispatch_36.ListA, Motion=Z_53)  # -> Geometry, Transform
subtraction_10 = Subtraction(A=höhe_attika, B=dicke_abschlussbrett)
cluster_2 = Cluster(grundriss=move_32.Geometry, A=Slider(180, range=-180..180), wand=rectangle_7.Rectangle)
move_34 = Move(Geometry=dispatch_37.ListA, Motion=Z_54)  # -> Geometry, Transform
panel_336 = Panel("Dicke Ringbalken / Decke")
cluster_3 = Cluster(grundriss=move_33.Geometry, A=Slider(0, range=-180..180), wand=rectangle_6.Rectangle)
num_73 = Number(dicke_betondecke)
data_64 = Data(cluster_3)
subtraction_11 = Subtraction(A=subtraction_10, B=num_73)
Z_55 = UnitZ(Factor=num_73)
data_65 = Data(cluster_2)
move_35 = Move(Geometry=move_34.Geometry, Motion=Z_55)  # -> Geometry, Transform
Z_56 = UnitZ(Factor=subtraction_11)
extr_40 = Extrude(Base=move_35.Geometry, Direction=Z_56)
cap_3 = CapHoles(Brep=data_64)
cap_4 = CapHoles(Brep=extr_40)
fastsdiff_14 = FastSolidDifference(
    SubtractFrom=data_65,
    SubtractWith=cap_4,
    Tolerance=0.01,
    computeBBFastSolidDiff=True,
    retainFastSolidDiff=True,
    strictFastSolidDiff=True,
    trueIntFastSolidDiff=False)
data_66 = Data([cap_4, cap_3])
data_67 = Data(fastsdiff_14)

# ----
dispatch_38 = Dispatch(List=data_46, DispatchPattern=bool_3)  # -> ListA, ListB
Z_57 = UnitZ(Factor=num_67)
move_36 = Move(Geometry=dispatch_38.ListA, Motion=Z_57)  # -> Geometry, Transform
offset_23 = OffsetCurve(Curve=move_36.Geometry, Distance=data_19, Corners=1)
boundary_19 = BoundarySurfaces(Edges=flatten([offset_23, move_36.Geometry]))
Z_58 = UnitZ(Factor=höhe_attika)
extr_41 = Extrude(Base=boundary_19, Direction=Z_58)
dispatch_39 = Dispatch(List=extr_41, DispatchPattern=bool_4)  # -> ListA, ListB
data_68 = Data(dispatch_39.ListB)

# ----
# Hier noch korregieren Holz
# Randkurve Wand für Sweep Innere Abdichtung
# Brep Mauer für Abdichtung Oberseite Mauer
panel_346 = Panel("Raumhöhe")
dispatch_40 = Dispatch(List=data_47, DispatchPattern=bool_3)  # -> ListA, ListB
Z_59 = UnitZ(Factor=num_67)
num_74 = Number(data_20)
move_37 = Move(Geometry=dispatch_40.ListA, Motion=Z_59)  # -> Geometry, Transform
num_75 = Number(höhe_attika)
offset_24 = OffsetCurve(Curve=move_37.Geometry, Distance=num_74, Corners=1)
addition_7 = Addition(A=num_75, B=num_74)
boundary_20 = BoundarySurfaces(Edges=flatten([move_37.Geometry, offset_24]))
Z_60 = UnitZ(Factor=addition_7)
extr_42 = Extrude(Base=boundary_20, Direction=Z_60)
Z_61 = UnitZ(Factor=höhe_attika)
brep_4 = Brep(boundary_19)
move_38 = Move(Geometry=brep_4, Motion=Z_61)  # -> Geometry, Transform
Z_62 = UnitZ(Factor=num_74)
extr_43 = Extrude(Base=move_38.Geometry, Direction=Z_62)
addition_8 = Addition(A=höhe_attika, B=num_67)
num_76 = Number(data_20)
crv_39 = Curve(data_46)
addition_9 = Addition(A=addition_8, B=num_76)
dispatch_41 = Dispatch(List=crv_39, DispatchPattern=bool_3)  # -> ListA, ListB
Z_63 = UnitZ(Factor=addition_9)
panel_357 = Panel("Dicke Deckenplatte")
move_39 = Move(Geometry=dispatch_41.ListA, Motion=Z_63)  # -> Geometry, Transform
num_77 = Number(höhe_attika)
neg_13 = Negative(Value=num_76)
subtraction_12 = Subtraction(A=num_77, B=dicke_betondecke)
offset_25 = OffsetCurve(Curve=move_39.Geometry, Distance=neg_13, Corners=1)
neg_14 = Negative(Value=subtraction_12)
boundary_21 = BoundarySurfaces(Edges=flatten([offset_25, move_39.Geometry]))
Z_64 = UnitZ(Factor=neg_14)
extr_44 = Extrude(Base=boundary_21, Direction=Z_64)
data_69 = Data(extr_44)
data_70 = Data([data_69, extr_42, extr_43])

# ----
# Randkurve Wand für Sweep Innere Dämmung
# Kurve Abdichtung Dach Oben Außen
panel_360 = Panel("Raumhöhe")
dispatch_42 = Dispatch(List=data_48, DispatchPattern=bool_3)  # -> ListA, ListB
Z_65 = UnitZ(Factor=num_67)
panel_363 = Panel("Dicke Aüßere Dämmung")
move_40 = Move(Geometry=dispatch_42.ListA, Motion=Z_65)  # -> Geometry, Transform
panel_364 = Panel("Dicke Dach Dämmung")
num_78 = Number(data_21)
num_79 = Number(höhe_attika)
num_80 = Number(dicke_dämmung)
offset_26 = OffsetCurve(Curve=move_40.Geometry, Distance=num_78, Corners=1)
addition_10 = Addition(A=num_79, B=num_80)
boundary_22 = BoundarySurfaces(Edges=flatten([move_40.Geometry, offset_26]))
Z_66 = UnitZ(Factor=addition_10)
extr_45 = Extrude(Base=boundary_22, Direction=Z_66)
num_81 = Number(data_21)
smaller_8 = SmallerThan(FirstNumber=num_81, SecondNumber="0")  # -> SmallerThan, OrEqualTo
data_71 = Data(extr_45)
dispatch_43 = Dispatch(List=data_71, DispatchPattern=smaller_8.OrEqualTo)  # -> ListA, ListB
data_72 = Data(dispatch_43.ListB)
num_82 = Number(data_20)
multiplication_26 = Multiplication(A=num_82, B="2")
crv_40 = Curve(offset_25)
num_83 = Number(data_19)
addition_11 = Addition(A=num_83, B=multiplication_26)
offset_27 = OffsetCurve(Curve=crv_40, Distance=addition_11, Corners=1)
num_84 = Number(dicke_dämmung)
num_85 = Number(data_20)
boundary_23 = BoundarySurfaces(Edges=flatten([crv_40, offset_27]))
subtraction_13 = Subtraction(A=num_84, B=num_85)
Z_67 = UnitZ(Factor=subtraction_13)
extr_46 = Extrude(Base=boundary_23, Direction=Z_67)
num_86 = Number(dicke_dämmung)
addition_12 = Addition(A=höhe_attika, B=num_67)
num_87 = Number(data_20)
crv_41 = Curve(data_46)
addition_13 = Addition(A=addition_12, B=num_86)
dispatch_44 = Dispatch(List=crv_41, DispatchPattern=bool_3)  # -> ListA, ListB
Z_68 = UnitZ(Factor=addition_13)
move_41 = Move(Geometry=dispatch_44.ListA, Motion=Z_68)  # -> Geometry, Transform
neg_15 = Negative(Value=num_87)
offset_28 = OffsetCurve(Curve=move_41.Geometry, Distance=neg_15, Corners=1)
neg_16 = Negative(Value=num_86)
num_88 = Number(höhe_attika)
offset_29 = OffsetCurve(Curve=offset_28, Distance=neg_16, Corners=1)
subtraction_14 = Subtraction(A=num_88, B=dicke_betondecke)
neg_17 = Negative(Value=subtraction_14)
boundary_24 = BoundarySurfaces(Edges=flatten([offset_29, offset_28]))
Z_69 = UnitZ(Factor=neg_17)
extr_47 = Extrude(Base=boundary_24, Direction=Z_69)
data_73 = Data(extr_47)
panel_380 = Panel("Abzug Abdichtung")
fastsdiff_15 = FastSolidDifference(
    SubtractFrom=data_73,
    SubtractWith=data_69,
    Tolerance=0.01,
    computeBBFastSolidDiff=True,
    retainFastSolidDiff=True,
    strictFastSolidDiff=True,
    trueIntFastSolidDiff=False)
data_74 = Data([fastsdiff_15, extr_46, data_72])

dispatch_45 = Dispatch(List=data_46, DispatchPattern=bool_3)  # -> ListA, ListB
Z_70 = UnitZ(Factor=num_67)
move_42 = Move(Geometry=dispatch_45.ListA, Motion=Z_70)  # -> Geometry, Transform
panel_385 = Panel("Dicke Betondecke")
Z_71 = UnitZ(Factor=dicke_betondecke)
fpatch_7 = FragmentPatch(Boundary=move_42.Geometry)
number_slider_5 = Slider(2.86, range=1..5)
extr_48 = Extrude(Base=fpatch_7, Direction=Z_71)
move_43 = Move(Geometry=move_42.Geometry, Motion=Z_71)  # -> Geometry, Transform
roof_2 = ModelRoof(Curve=move_43.Geometry, Angle=number_slider_5, indexSize=1, showIndices=False)
join_9 = BrepJoin(Breps=roof_2)  # -> Breps, Closed
bbox = BoundingBox(Content=join_9.Breps, Plane=PlaneXY(0, 0, 0))  # -> Box, Box_2
debox = DeconstructBox(Box=bbox.Box)  # -> Plane, X, Y, Z
Z_72 = UnitZ(Factor=debox.Z)
rev_2 = Reverse(Vector=Z_72)
extr_49 = Extrude(Base=join_9.Breps, Direction=rev_2)
data_75 = Data(extr_48)
panel_386 = Panel("Betondecke")
brep_5 = Brep(join_9.Breps)
fastsdiff_16 = FastSolidDifference(
    SubtractFrom=extr_49,
    SubtractWith=extr_48,
    Tolerance=0.01,
    computeBBFastSolidDiff=True,
    retainFastSolidDiff=True,
    strictFastSolidDiff=True,
    trueIntFastSolidDiff=False)
panel_387 = Panel("Dicke Dampfsperre")
data_76 = Data(fastsdiff_16)
panel_388 = Panel("Gefälleestrich")
Z_73 = UnitZ(Factor=dicke_dampfsperre_2)
move_44 = Move(Geometry=brep_5, Motion=Z_73)  # -> Geometry, Transform
extr_50 = Extrude(Base=brep_5, Direction=Z_73)
Z_74 = UnitZ(Factor=dicke_dämmung)
data_77 = Data(extr_50)
extr_51 = Extrude(Base=move_44.Geometry, Direction=Z_74)
move_45 = Move(Geometry=move_44.Geometry, Motion=Z_74)  # -> Geometry, Transform
fastsdiff_17 = FastSolidDifference(
    SubtractFrom=extr_51,
    SubtractWith=data_69,
    Tolerance=0.01,
    computeBBFastSolidDiff=True,
    retainFastSolidDiff=True,
    strictFastSolidDiff=True,
    trueIntFastSolidDiff=False)
Z_75 = UnitZ(Factor=data_20)
panel_393 = Panel("""Abzug Abdichtung
+ Dämmung""")
extr_52 = Extrude(Base=move_45.Geometry, Direction=Z_75)
data_78 = Data(fastsdiff_17)
fastsdiff_18 = FastSolidDifference(
    SubtractFrom=extr_52,
    SubtractWith=[data_69, data_73],
    Tolerance=0.01,
    computeBBFastSolidDiff=True,
    retainFastSolidDiff=True,
    strictFastSolidDiff=True,
    trueIntFastSolidDiff=False)
data_79 = Data(fastsdiff_18)

brep_6 = Brep(join_9.Breps)  # disabled
debrep_3 = DeconstructBrep(Brep=brep_6)  # -> Faces, Edges, Vertices; disabled
flip_3 = Flip(Surface=debrep_3.Faces)  # -> Surface, Result; disabled

# ----
# Kurve Dämmung Dach Oben Außen
panel_396 = Panel("Raumhöhe")
dispatch_46 = Dispatch(List=data_49, DispatchPattern=bool_3)  # -> ListA, ListB
Z_76 = UnitZ(Factor=num_67)
move_46 = Move(Geometry=dispatch_46.ListA, Motion=Z_76)  # -> Geometry, Transform
num_89 = Number(dicke_dämmung)
num_90 = Number(höhe_attika)
num_91 = Number(data_23)
ma_6 = MassAddition(Input=[num_90, num_89])  # -> Result, PartialResults
offset_30 = OffsetCurve(Curve=move_46.Geometry, Distance=num_91, Corners=1)
boundary_25 = BoundarySurfaces(Edges=flatten([offset_30, move_46.Geometry]))
Z_77 = UnitZ(Factor=ma_6.Result)
extr_53 = Extrude(Base=boundary_25, Direction=Z_77)
data_80 = Data(extr_53)
num_92 = Number(höhe_attika)
num_93 = Number(dicke_dämmung)
addition_14 = Addition(A=num_92, B=num_93)
Z_78 = UnitZ(Factor=addition_14)
move_47 = Move(Geometry=offset_30, Motion=Z_78)  # -> Geometry, Transform
crv_42 = Curve(offset_29)
boundary_26 = BoundarySurfaces(Edges=flatten([move_47.Geometry, crv_42]))
num_94 = Number(data_20)
Z_79 = UnitZ(Factor=num_94)
extr_54 = Extrude(Base=boundary_26, Direction=Z_79)
move_48 = Move(Geometry=crv_42, Motion=Z_79)  # -> Geometry, Transform
num_95 = Number(höhe_attika)
num_96 = Number(data_20)
subtraction_15 = Subtraction(A=num_95, B=dicke_betondecke)
neg_18 = Negative(Value=num_96)
offset_31 = OffsetCurve(Curve=move_48.Geometry, Distance=neg_18, Corners=1)
addition_15 = Addition(A=subtraction_15, B=num_96)
neg_19 = Negative(Value=addition_15)
boundary_27 = BoundarySurfaces(Edges=flatten([offset_31, move_48.Geometry]))
Z_80 = UnitZ(Factor=neg_19)
extr_55 = Extrude(Base=boundary_27, Direction=Z_80)
data_81 = Data([extr_54, extr_55])

num_97 = Number(data_20)
num_98 = Number(data_20)
num_99 = Number(data_21)
num_100 = Number(dicke_dämmung)
num_101 = Number(data_19)
num_102 = Number(dicke_dampfsperre_2)
num_103 = Number(data_22)
num_104 = Number(data_23)
panel_410 = Panel("Abdichtung 2 mal")
num_105 = Number(num_97)
num_106 = Number(num_97)
panel_411 = Panel("Dicke Dichtung")
panel_415 = Panel("Dachneigung Flachdach")
dispatch_47 = Dispatch(List=data_50, DispatchPattern=bool_3)  # -> ListA, ListB
addition_16 = Addition(A=höhe_attika, B=num_67)
num_107 = Number(data_20)
num_108 = Number(dicke_dämmung)
ma_7 = MassAddition(Input=[num_97, num_98, num_100, num_99, num_101, num_102, num_106, num_103, num_105, num_104])  # -> Result, PartialResults
rad_3 = Radians(Degrees=number_slider_5)
addition_17 = Addition(A=addition_16, B=num_107)
tan = Tangent(Value=rad_3)
addition_18 = Addition(A=num_108, B=addition_17)
multiplication_27 = Multiplication(A=tan, B=ma_7.Result)
neg_20 = Negative(Value=ma_7.Result)
addition_19 = Addition(A=addition_18)
Z_81 = UnitZ(Factor=multiplication_27)
Z_82 = UnitZ(Factor=addition_19)
num_109 = Number(höhe_attika)
move_49 = Move(Geometry=dispatch_47.ListA, Motion=Z_82)  # -> Geometry, Transform
division_2 = Division(A=num_109, B="4")
offset_32 = OffsetCurve(Curve=move_49.Geometry, Distance=neg_20, Corners=1)

# ---- group: Dachbalken
höhe_dachträger = Slider(0.3, range=0..1)
breite_dachträger = Slider(0.3, range=0..1)
panel_420 = Panel("Dach Brep Joined")
edges_10 = BrepEdges(Brep=join_8.Breps)  # -> Naked, graft(Interior), NonManifold
neg_21 = Negative(Value=höhe_dachträger)
join_10 = JoinCurves(Curves=edges_10.Naked, Preserve=False)
Z_83 = UnitZ(Factor=neg_21)
crv_43 = Curve(edges_10.Interior)
move_50 = Move(Geometry=crv_43, Motion=Z_83)  # -> Geometry, Transform
rad_4 = Radians(Degrees="90")
xy_3 = XYPlane(Origin=Point(0, 0, 0))
eval_4 = EvaluateCurve(Curve=move_50.Geometry, Parameter="0")  # -> Point, Tangent, Angle
rulesrf = RuledSurface(CurveA=crv_43, CurveB=move_50.Geometry)
Z_84 = UnitZ(Factor=1)
pdecon = Deconstruct(Point=eval_4.Tangent)  # -> XComponent, YComponent, ZComponent
crv_44 = Curve(join_10)
move_51 = Move(Geometry=crv_44, Motion=Z_84)  # -> Geometry, Transform
vec_9 = VectorXYZ(XComponent=pdecon.XComponent, YComponent=pdecon.YComponent, ZComponent=0)  # -> Vector, Length
rotate_3 = Rotate(Geometry=vec_9.Vector, Angle=rad_4, Plane=xy_3)  # -> Geometry, Transform
division_3 = Division(A=breite_dachträger, B="2")
multiplication_28 = Multiplication(A=rotate_3.Geometry, B=division_3)
Z_85 = UnitZ(Factor="-2")
neg_22 = Negative(Value=multiplication_28)
extr_56 = Extrude(Base=move_51.Geometry, Direction=Z_85)
flippsrf = FlipPolysurface(Polysurface=extr_56)  # -> Flipped, R
extr_57 = Extrude(Base=rulesrf, Direction=[neg_22, multiplication_28])
offsrf_2 = OffsetSurface(Surface=flippsrf.Flipped, Distance="1", BothSides=0, CreateSolid=True)
cap_5 = CapHoles(Brep=extr_57)
fastsunion = FastSolidUnion(Breps=flatten(cap_5), Tolerance=0.01, strictFastSolidUnion=True, trueIntFastSolidUnion=False)  # -> graft(Result)
Z_86 = UnitZ(Factor=1)
fastsdiff_19 = FastSolidDifference(
    SubtractFrom=fastsunion,
    SubtractWith=offsrf_2,
    Tolerance=0.01,
    computeBBFastSolidDiff=True,
    retainFastSolidDiff=True,
    strictFastSolidDiff=True,
    trueIntFastSolidDiff=False)
extr_58 = Extrude(Base=join_8.Breps, Direction=Z_86)
fastsdiff_20 = FastSolidDifference(
    SubtractFrom=fastsdiff_19,
    SubtractWith=extr_58,
    Tolerance=0.01,
    computeBBFastSolidDiff=True,
    retainFastSolidDiff=True,
    strictFastSolidDiff=True,
    trueIntFastSolidDiff=False)
data_82 = Data(fastsdiff_20)

# ----
neg_23 = Negative(Value=division_2)
Z_87 = UnitZ(Factor=neg_23)
move_52 = Move(Geometry=offset_32, Motion=Z_81)  # -> Geometry, Transform
move_53 = Move(Geometry=move_49.Geometry, Motion=Z_87)  # -> Geometry, Transform
num_110 = Number(höhe_attika)
loft = Loft(
    Curves=flatten([move_52.Geometry, move_49.Geometry]),
    Options={Adjust=False, Closed=False, LoftEnds=0, LoftSimp=0, LoftType=0, Rebuild=10, Refit=0.01})
division_4 = Division(A=num_110, B="4")
loft_2 = Loft(
    Curves=flatten([move_49.Geometry, move_53.Geometry]),
    Options={Adjust=False, Closed=False, LoftEnds=0, LoftSimp=0, LoftType=0, Rebuild=10, Refit=0.01})
neg_24 = Negative(Value=division_4)
Z_88 = UnitZ(Factor=neg_24)
move_54 = Move(Geometry=move_52.Geometry, Motion=Z_88)  # -> Geometry, Transform
loft_3 = Loft(
    Curves=flatten([move_54.Geometry, move_52.Geometry]),
    Options={Adjust=False, Closed=False, LoftEnds=0, LoftSimp=0, LoftType=0, Rebuild=10, Refit=0.01})
join_11 = BrepJoin(Breps=[loft_2, loft, loft_3])  # -> Breps, Closed
abdeckung_dach_dicke = Slider(0.015, range=0.01..0.02)
offsrf_3 = OffsetSurface(Surface=join_11.Breps, Distance=abdeckung_dach_dicke, BothSides=0, CreateSolid=True)
data_83 = Data(offsrf_3)

# ---- group: Dachziegel / Dachziegel Geo
x_size = Slider(0.2, range=0..1)
number_slider_6 = Slider(0.35, range=0..1)
offset_33 = Slider(0.01, range=0..1)
dom_5 = ConstructDomain(DomainStart=expr("-x/2", x_size), DomainEnd=expr("x/2", x_size))
planesrf = PlaneSurface(Plane=PlaneXY(0, 0, 0), XSize=dom_5, YSize=number_slider_6)
Z_89 = UnitZ(Factor=offset_33)
move_55 = Move(Geometry=planesrf, Motion=Z_89)  # -> Geometry, Transform
yz = YZPlane(Origin=Point(0, 0, 0))
rotate_4 = Rotate(Geometry=move_55.Geometry, Angle=degrees(Slider(3.02, range=0..15)), Plane=yz)  # -> Geometry, Transform
loft_4 = Loft(
    Curves=[planesrf, rotate_4.Geometry],
    Options={Adjust=False, Closed=False, LoftEnds=0, LoftSimp=0, LoftType=0, Rebuild=10, Refit=0.01})
join_12 = BrepJoin(Breps=[planesrf, loft_4, rotate_4.Geometry])  # -> Breps, Closed
rotate_5 = Rotate(Geometry=join_12.Breps, Angle=expr("-x", degrees(Slider(4, range=0..15))), Plane=yz)  # -> Geometry, Transform

# ---- group: Dachaufbau
dicke_aufsparrendämmung = Slider(0.1, range=0..0.1)
dicke_vorverdeckung = Slider(0.005, range=0.001..0.1)
dicke_unterspannbahn = Slider(0.005, range=0.001..0.1)
brep_7 = Brep(join_8.Breps)
Z_90 = UnitZ(Factor=dicke_unterspannbahn)
Z_91 = UnitZ(Factor=dicke_aufsparrendämmung)
Z_92 = UnitZ(Factor=dicke_vorverdeckung)
move_56 = Move(Geometry=brep_7, Motion=Z_90)  # -> Geometry, Transform
move_57 = Move(Geometry=move_56.Geometry, Motion=Z_91)  # -> Geometry, Transform
extr_59 = Extrude(Base=move_57.Geometry, Direction=Z_92)
extr_60 = Extrude(Base=move_56.Geometry, Direction=Z_91)
extr_61 = Extrude(Base=brep_7, Direction=Z_90)
data_84 = Data([extr_61, extr_59])
data_85 = Data(extr_60)

# ---- group: Dachaufbau / Konterlattung
panel_428 = Panel("Addition Dachaufbau Höhe")
ma_8 = MassAddition(Input=[dicke_unterspannbahn, dicke_aufsparrendämmung, dicke_vorverdeckung])  # -> Result, PartialResults
num_111 = Number(num_26)
panel_430 = Panel("Verschiebung Geo Pfetten")
Z_93 = UnitZ(Factor=ma_8.Result)
Z_94 = UnitZ(Factor=num_111)

# ---- group: Dachaufbau (continued)
ma_9 = MassAddition(Input=[ma_8.Result, num_111])  # -> Result, PartialResults
Z_95 = UnitZ(Factor=ma_9.Result)
move_58 = Move(Geometry=brep_7, Motion=Z_95)  # -> Geometry, Transform

# ---- group: Zwischensparrendämmung und Cutoff für Dämmung
panel_432 = Panel("Höhe Dachpfetten")
brep_8 = Brep(join_8.Breps)
panel_434 = Panel("""Extrusion Pfette &
Dachbalken""")

# ---- group: Dachlatten
# Output Wand Kurve Grundriss
panel_436 = Panel("Dach Brep")
brep_9 = Brep(graft(roof))
panel_437 = Panel("Raumhöhe Vektor")
crv_45 = Curve(data_46)
move_59 = Move(Geometry=crv_45, Motion=Z_51)  # -> Geometry, Transform
edges_11 = BrepEdges(Brep=move_59.Geometry)  # -> Naked, Interior, NonManifold
len_6 = Length(Curve=edges_11.Naked)
divide_3 = DivideCurve(Curve=edges_11.Naked, Count=len_6, Kinks=False)  # -> Points, Tangents, Parameters
item_7 = ListItem(List=divide_3.Points, Index="0", Wrap=True)
item_8 = ListItem(List=divide_3.Points, Index="0", Wrap=True)
item_9 = ListItem(List=divide_3.Tangents, Index="0", Wrap=True)
dist_3 = Distance(PointA=item_8, PointB=divide_3.Points)
bnd_7 = Bounds(Numbers=dist_3)
dedom2num_3 = DeconstructDomain²(Domain=bnd_7)  # -> UMin, UMax, VMin, VMax
subtraction_16 = Subtraction(A=dedom2num_3.UMax, B=num_26)
dom_6 = ConstructDomain(DomainStart=0, DomainEnd=subtraction_16)
remap_4 = RemapNumbers(Value=dist_3, Source=bnd_7, Target=dom_6)  # -> Mapped, Clipped
item_10 = ListItem(List=remap_4.Mapped, Index="1", Wrap=True)
contour = Contour(Shape=brep_9, Point=item_7, Direction=item_9, Distance=item_10)
eval_5 = EvaluateCurve(Curve=contour, Parameter="0")  # -> Point, Tangent, Angle
pdecon_2 = Deconstruct(Point=eval_5.Tangent)  # -> XComponent, YComponent, ZComponent
rad_5 = Radians(Degrees="270")
xy_4 = XYPlane(Origin=Point(0, 0, 0))
vec_10 = VectorXYZ(XComponent=pdecon_2.XComponent, YComponent=pdecon_2.YComponent, ZComponent=0)  # -> Vector, Length
höhe_dachpfetten = Slider(0.2, range=0.1..1)
rotate_6 = Rotate(Geometry=vec_10.Vector, Angle=rad_5, Plane=xy_4)  # -> Geometry, Transform
multiplication_29 = Multiplication(A=num_26, B=rotate_6.Geometry)
Z_96 = UnitZ(Factor=höhe_dachpfetten)
neg_25 = Negative(Value=Z_96)
extr_62 = Extrude(Base=contour, Direction=multiplication_29)
extr_63 = Extrude(Base=extr_62, Direction=neg_25)
panel_440 = Panel("Sdiff Dachbalken")
fastsdiff_21 = FastSolidDifference(
    SubtractFrom=extr_63,
    SubtractWith=graft(fastsdiff_20),
    Tolerance=0.01,
    computeBBFastSolidDiff=True,
    retainFastSolidDiff=True,
    strictFastSolidDiff=True,
    trueIntFastSolidDiff=False)
panel_441 = Panel("Abzug Ringbalken Dachbalken")

# ----
addition_20 = Addition(A=ma_9.Result, B=höhe_dachpfetten)  # disabled
neg_26 = Negative(Value=addition_20)  # disabled
Z_97 = UnitZ(Factor=neg_26)  # disabled
extr_64 = Extrude(Base=brep_6, Direction=Z_97)  # disabled

# ---- group: Zwischensparrendämmung und Cutoff für Dämmung (continued)
Z_98 = UnitZ(Factor=höhe_dachpfetten)
neg_27 = Negative(Value=Z_98)
move_60 = Move(Geometry=brep_8, Motion=neg_27)  # -> Geometry, Transform
extr_65 = Extrude(Base=brep_8, Direction=neg_27)
fastsunion_2 = FastSolidUnion(Breps=flatten([fastsunion, extr_63]), Tolerance=0.01, strictFastSolidUnion=True, trueIntFastSolidUnion=False)  # -> graft(Result)
fastsdiff_22 = FastSolidDifference(
    SubtractFrom=extr_65,
    SubtractWith=fastsunion_2,
    Tolerance=0.01,
    computeBBFastSolidDiff=True,
    retainFastSolidDiff=True,
    strictFastSolidDiff=True,
    trueIntFastSolidDiff=False)
data_86 = Data(fastsdiff_22)

# ----
dach_brep_unterseite = Brep(move_60.Geometry)
dach_brep_unterseite_2 = Brep(move_60.Geometry)
brep_10 = Brep(dach_brep_unterseite_2)
extr_66 = Extrude(Base=brep_10, Direction=Z_8)
fastsdiff_23 = FastSolidDifference(
    SubtractFrom=graft(join_5.Breps),
    SubtractWith=extr_66,
    Tolerance=0.01,
    computeBBFastSolidDiff=True,
    retainFastSolidDiff=True,
    strictFastSolidDiff=True,
    trueIntFastSolidDiff=False)
data_87 = Data([join_6.Breps, fastsdiff_23])
fastsdiff_24 = FastSolidDifference(
    SubtractFrom=data_87,
    SubtractWith=boxrec,
    Tolerance=0.01,
    computeBBFastSolidDiff=True,
    retainFastSolidDiff=True,
    strictFastSolidDiff=True,
    trueIntFastSolidDiff=False)
data_88 = Data(fastsdiff_24)
bcx = BrepCurve(Brep=dach_brep_unterseite_2, Curve=line, UseTasks=False)  # -> Curves, flatten(Points)
bcx_2 = BrepCurve(Brep=dach_brep_unterseite_2, Curve=line_2, UseTasks=False)  # -> Curves, flatten(Points)
dist_4 = Distance(PointA=midpt_3, PointB=bcx.Points)
dist_5 = Distance(PointA=midpt_5, PointB=bcx_2.Points)
bnd_8 = Bounds(Numbers=dist_4)
bnd_9 = Bounds(Numbers=dist_5)
fastsint = FastSolidIntersect(
    FirstBrepSet=dach_brep_unterseite_2,
    SecondBrepSet=extr_8,
    Tolerance=0.01,
    strictFastSolidInt=True,
    trueIntFastSolidInt=False)
dedomain_5 = DeconstructDomain(Domain=bnd_9)  # -> Start, End
Z_99 = UnitZ(Factor=dedomain_5.Start)
dedomain_6 = DeconstructDomain(Domain=bnd_8)  # -> Start, End
brep_11 = Brep(dach_brep_unterseite_2)
bcx_3 = BrepCurve(Brep=dach_brep_unterseite, Curve=line_3, UseTasks=False)  # -> Curves, Points
dispatch_48 = Dispatch(List=Z_99, DispatchPattern=bool_3)  # -> ListA, ListB
fastsint_2 = FastSolidIntersect(
    FirstBrepSet=dach_brep_unterseite_2,
    SecondBrepSet=extr_12,
    Tolerance=0.01,
    strictFastSolidInt=True,
    trueIntFastSolidInt=False)
brep_12 = Brep(dach_brep_unterseite_2)
fastsint_3 = FastSolidIntersect(
    FirstBrepSet=dach_brep_unterseite_2,
    SecondBrepSet=extr_11,
    Tolerance=0.01,
    strictFastSolidInt=True,
    trueIntFastSolidInt=False)
fastsint_4 = FastSolidIntersect(
    FirstBrepSet=dach_brep_unterseite_2,
    SecondBrepSet=extr_13,
    Tolerance=0.01,
    strictFastSolidInt=True,
    trueIntFastSolidInt=False)
fastsdiff_25 = FastSolidDifference(
    SubtractFrom=graft(extr_8),
    SubtractWith=fastsint,
    Tolerance=0.01,
    computeBBFastSolidDiff=True,
    retainFastSolidDiff=True,
    strictFastSolidDiff=True,
    trueIntFastSolidDiff=False)
extr_67 = Extrude(Base=brep_11, Direction=dispatch_10.ListB)
brep_13 = Brep(dach_brep_unterseite_2)
extr_68 = Extrude(Base=brep_12, Direction=dispatch_14.ListB)
trim_8 = TrimTree(Tree=bcx_3.Points, Depth=1)
subtraction_17 = Subtraction(A=dedomain_6.Start, B=dedomain_5.Start)
fastsdiff_26 = FastSolidDifference(
    SubtractFrom=graft(extr_10),
    SubtractWith=extr_67,
    Tolerance=0.01,
    computeBBFastSolidDiff=True,
    retainFastSolidDiff=True,
    strictFastSolidDiff=True,
    trueIntFastSolidDiff=False)
Z_100 = UnitZ(Factor=dedomain_5.Start)
extr_69 = Extrude(Base=brep_13, Direction=dispatch_12.ListB)
fastsdiff_27 = FastSolidDifference(
    SubtractFrom=graft(extr_12),
    SubtractWith=fastsint_2,
    Tolerance=0.01,
    computeBBFastSolidDiff=True,
    retainFastSolidDiff=True,
    strictFastSolidDiff=True,
    trueIntFastSolidDiff=False)
fastsdiff_28 = FastSolidDifference(
    SubtractFrom=graft(extr_11),
    SubtractWith=fastsint_3,
    Tolerance=0.01,
    computeBBFastSolidDiff=True,
    retainFastSolidDiff=True,
    strictFastSolidDiff=True,
    trueIntFastSolidDiff=False)
fastsdiff_29 = FastSolidDifference(
    SubtractFrom=graft(extr_13),
    SubtractWith=fastsint_4,
    Tolerance=0.01,
    computeBBFastSolidDiff=True,
    retainFastSolidDiff=True,
    strictFastSolidDiff=True,
    trueIntFastSolidDiff=False)
fastsdiff_30 = FastSolidDifference(
    SubtractFrom=graft(extr_14),
    SubtractWith=extr_68,
    Tolerance=0.01,
    computeBBFastSolidDiff=True,
    retainFastSolidDiff=True,
    strictFastSolidDiff=True,
    trueIntFastSolidDiff=False)
brep_14 = Brep(dach_brep_unterseite_2)
dist_6 = Distance(PointA=trim_8, PointB=midpt_4)
fastsdiff_31 = FastSolidDifference(
    SubtractFrom=graft(extr_15),
    SubtractWith=extr_69,
    Tolerance=0.01,
    computeBBFastSolidDiff=True,
    retainFastSolidDiff=True,
    strictFastSolidDiff=True,
    trueIntFastSolidDiff=False)
brep_15 = Brep(dach_brep_unterseite_2)
extr_70 = Extrude(Base=boundary_10, Direction=[dispatch_25.ListA, dispatch_48.ListB])
move_61 = Move(Geometry=boundary_10, Motion=Z_100)  # -> Geometry, Transform
fastsdiff_32 = FastSolidDifference(
    SubtractFrom=graft(fastsdiff_25),
    SubtractWith=data_26,
    Tolerance=0.01,
    computeBBFastSolidDiff=True,
    retainFastSolidDiff=True,
    strictFastSolidDiff=True,
    trueIntFastSolidDiff=False)
Z_101 = UnitZ(Factor=subtraction_17)
extr_71 = Extrude(Base=brep_14, Direction=dispatch_19.ListB)
extr_72 = Extrude(Base=brep_15, Direction=dispatch_21.ListB)
bnd_10 = Bounds(Numbers=dist_6)
fastsdiff_33 = FastSolidDifference(
    SubtractFrom=graft(fastsdiff_26),
    SubtractWith=data_26,
    Tolerance=0.01,
    computeBBFastSolidDiff=True,
    retainFastSolidDiff=True,
    strictFastSolidDiff=True,
    trueIntFastSolidDiff=False)
fastsdiff_34 = FastSolidDifference(
    SubtractFrom=graft(extr_19),
    SubtractWith=extr_71,
    Tolerance=0.01,
    computeBBFastSolidDiff=True,
    retainFastSolidDiff=True,
    strictFastSolidDiff=True,
    trueIntFastSolidDiff=False)
fastsdiff_35 = FastSolidDifference(
    SubtractFrom=graft(fastsdiff_29),
    SubtractWith=data_26,
    Tolerance=0.01,
    computeBBFastSolidDiff=True,
    retainFastSolidDiff=True,
    strictFastSolidDiff=True,
    trueIntFastSolidDiff=False)
bcx_4 = BrepCurve(Brep=dach_brep_unterseite, Curve=line_4, UseTasks=False)  # -> Curves, flatten(Points)
extr_73 = Extrude(Base=move_61.Geometry, Direction=Z_101)
bcx_5 = BrepCurve(Brep=dach_brep_unterseite, Curve=line_5, UseTasks=False)  # -> Curves, flatten(Points)
fastsdiff_36 = FastSolidDifference(
    SubtractFrom=graft(fastsdiff_27),
    SubtractWith=data_26,
    Tolerance=0.01,
    computeBBFastSolidDiff=True,
    retainFastSolidDiff=True,
    strictFastSolidDiff=True,
    trueIntFastSolidDiff=False)
fastsdiff_37 = FastSolidDifference(
    SubtractFrom=graft(fastsdiff_28),
    SubtractWith=data_26,
    Tolerance=0.01,
    computeBBFastSolidDiff=True,
    retainFastSolidDiff=True,
    strictFastSolidDiff=True,
    trueIntFastSolidDiff=False)
dedomain_7 = DeconstructDomain(Domain=bnd_10)  # -> Start, End
fastsdiff_38 = FastSolidDifference(
    SubtractFrom=graft(extr_20),
    SubtractWith=extr_72,
    Tolerance=0.01,
    computeBBFastSolidDiff=True,
    retainFastSolidDiff=True,
    strictFastSolidDiff=True,
    trueIntFastSolidDiff=False)
fastsdiff_39 = FastSolidDifference(
    SubtractFrom=graft(fastsdiff_30),
    SubtractWith=data_26,
    Tolerance=0.01,
    computeBBFastSolidDiff=True,
    retainFastSolidDiff=True,
    strictFastSolidDiff=True,
    trueIntFastSolidDiff=False)
fastsdiff_40 = FastSolidDifference(
    SubtractFrom=graft(extr_70),
    SubtractWith=data_26,
    Tolerance=0.01,
    computeBBFastSolidDiff=True,
    retainFastSolidDiff=True,
    strictFastSolidDiff=True,
    trueIntFastSolidDiff=False)
fastsdiff_41 = FastSolidDifference(
    SubtractFrom=graft(fastsdiff_31),
    SubtractWith=data_26,
    Tolerance=0.01,
    computeBBFastSolidDiff=True,
    retainFastSolidDiff=True,
    strictFastSolidDiff=True,
    trueIntFastSolidDiff=False)
data_89 = Data([fastsdiff_32, fastsdiff_3])
dist_7 = Distance(PointA=midpt_6, PointB=bcx_4.Points)
dist_8 = Distance(PointA=midpt_7, PointB=bcx_5.Points)
data_90 = Data([fastsdiff_33, fastsdiff_6])
dispatch_49 = Dispatch(List=dedomain_7.Start, DispatchPattern=bool_3)  # -> ListA, ListB
data_91 = Data(fastsdiff_40)
data_92 = Data([data_91, data_75, data_76, data_68, data_58, data_54, data_52])
custom_preview_2 = CustomPreview(Geometry=data_92, Material=create_material)
fastsdiff_42 = FastSolidDifference(
    SubtractFrom=graft(extr_73),
    SubtractWith=data_26,
    Tolerance=0.01,
    computeBBFastSolidDiff=True,
    retainFastSolidDiff=True,
    strictFastSolidDiff=True,
    trueIntFastSolidDiff=False)
data_93 = Data([fastsdiff_35, fastsdiff_2])
data_94 = Data([fastsdiff_37, fastsdiff_5])
data_95 = Data([data_94, data_77, data_79, data_70, data_81, data_57, data_53, data_90, data_84])
custom_preview_3 = CustomPreview(Geometry=data_95, Material=create_material_4)
fastsdiff_43 = FastSolidDifference(
    SubtractFrom=graft(fastsdiff_34),
    SubtractWith=data_26,
    Tolerance=0.01,
    computeBBFastSolidDiff=True,
    retainFastSolidDiff=True,
    strictFastSolidDiff=True,
    trueIntFastSolidDiff=False)
bnd_11 = Bounds(Numbers=dist_7)
bnd_12 = Bounds(Numbers=dist_8)
data_96 = Data([fastsdiff_39, fastsdiff_7])
data_97 = Data([data_93, data_80, data_60, data_96])
custom_preview_4 = CustomPreview(Geometry=data_97, Material=create_material_6)
fastsdiff_44 = FastSolidDifference(
    SubtractFrom=graft(fastsdiff_38),
    SubtractWith=data_26,
    Tolerance=0.01,
    computeBBFastSolidDiff=True,
    retainFastSolidDiff=True,
    strictFastSolidDiff=True,
    trueIntFastSolidDiff=False)
data_98 = Data([fastsdiff_41, fastsdiff_9])
data_99 = Data([fastsdiff_36, fastsdiff_4])
dedomain_8 = DeconstructDomain(Domain=bnd_11)  # -> Start, End
dedomain_9 = DeconstructDomain(Domain=bnd_12)  # -> Start, End
data_100 = Data(fastsdiff_42)
dispatch_50 = Dispatch(List=data_99, DispatchPattern=smaller_6.OrEqualTo)  # -> ListA, ListB
Z_102 = UnitZ(Factor=dispatch_49.ListB)
data_101 = Data([fastsdiff_44, fastsdiff_8])
data_102 = Data([data_89, data_88, data_101])
custom_preview_5 = CustomPreview(Geometry=data_102, Material=create_material_8)
data_103 = Data([fastsdiff_43, fastsdiff_10])
subtraction_18 = Subtraction(A=dedomain_8.Start, B=dedomain_9.Start)
# Extrusions höhe Dämmung minus Ringbalken höhe
subtraction_19 = Subtraction(A=dedomain_8.Start, B=subtraction_18)
Z_103 = UnitZ(Factor=subtraction_19)
Z_104 = UnitZ(Factor=dedomain_9.Start)
Z_105 = UnitZ(Factor=dedomain_9.Start)
dispatch_51 = Dispatch(List=Z_103, DispatchPattern=bool_3)  # -> ListA, ListB
move_62 = Move(Geometry=boundary_12, Motion=Z_104)  # -> Geometry, Transform
data_104 = Data(dispatch_50.ListB)
Z_106 = UnitZ(Factor=subtraction_18)
dispatch_52 = Dispatch(List=Z_105, DispatchPattern=bool_3)  # -> ListA, ListB
extr_74 = Extrude(Base=move_22.Geometry, Direction=dispatch_51.ListB)
extr_75 = Extrude(Base=move_62.Geometry, Direction=Z_106)
cap_6 = CapHoles(Brep=extr_74)
extr_76 = Extrude(Base=boundary_12, Direction=dispatch_52.ListB)
fastsdiff_45 = FastSolidDifference(
    SubtractFrom=graft(extr_75),
    SubtractWith=data_26,
    Tolerance=0.01,
    computeBBFastSolidDiff=True,
    retainFastSolidDiff=True,
    strictFastSolidDiff=True,
    trueIntFastSolidDiff=False)
fastsdiff_46 = FastSolidDifference(
    SubtractFrom=graft(cap_6),
    SubtractWith=data_26,
    Tolerance=0.01,
    UseTasks=False,
    computeBBFastSolidDiff=True,
    retainFastSolidDiff=True,
    strictFastSolidDiff=True,
    trueIntFastSolidDiff=False)
extr_77 = Extrude(Base=move_23.Geometry, Direction=Z_102)
data_105 = Data(fastsdiff_45)
cap_7 = CapHoles(Brep=extr_77)
data_106 = Data([fastsdiff_46, fastsdiff_11])
fastsdiff_47 = FastSolidDifference(
    SubtractFrom=extr_76,
    SubtractWith=data_106,
    Tolerance=0.01,
    computeBBFastSolidDiff=True,
    retainFastSolidDiff=True,
    strictFastSolidDiff=True,
    trueIntFastSolidDiff=False)
fastsdiff_48 = FastSolidDifference(
    SubtractFrom=graft(fastsdiff_47),
    SubtractWith=data_26,
    Tolerance=0.01,
    computeBBFastSolidDiff=True,
    retainFastSolidDiff=True,
    strictFastSolidDiff=True,
    trueIntFastSolidDiff=False)
data_107 = Data([fastsdiff_12, fastsdiff_48])
data_108 = Data([data_104, data_78, data_74, data_61, data_55, data_98, data_107, data_86, data_85, data_67])
custom_preview_6 = CustomPreview(Geometry=data_108, Material=create_material_3)
fastsdiff_49 = FastSolidDifference(
    SubtractFrom=graft(cap_7),
    SubtractWith=data_26,
    Tolerance=0.01,
    computeBBFastSolidDiff=True,
    retainFastSolidDiff=True,
    strictFastSolidDiff=True,
    trueIntFastSolidDiff=False)
data_109 = Data(fastsdiff_49)

# ---- group: Dachaufbau / Konterlattung (continued)
move_63 = Move(Geometry=extr_62, Motion=Z_93)  # -> Geometry, Transform
konterlattung = Extrude(Base=move_63.Geometry, Direction=Z_94)
data_110 = Data(konterlattung)

# ---- group: Dachlatten (continued)
fastsdiff_50 = FastSolidDifference(
    SubtractFrom=fastsdiff_21,
    SubtractWith=extr_73,
    Tolerance=0.01,
    computeBBFastSolidDiff=True,
    retainFastSolidDiff=True,
    strictFastSolidDiff=True,
    trueIntFastSolidDiff=False)
data_111 = Data(fastsdiff_50)

# ---- group: Dachlattung
panel_443 = Panel("Randkurven Dach (Knicke)")
edges_12 = BrepEdges(Brep=move_58.Geometry)  # -> Naked, Interior, NonManifold
debrep_4 = DeconstructBrep(Brep=move_58.Geometry)  # -> Faces, Edges, Vertices
join_13 = JoinCurves(Curves=edges_12.Naked, Preserve=False)
crv_46 = Curve(join_13)
eval_6 = EvaluateCurve(Curve=reparameterize(crv_46), Parameter="0")  # -> Point, Tangent, Angle
panel_445 = Panel("Dimension Dachziegeln")
dachlattung_dimensionen = Slider(0.06, range=0..0.1)
Z_107 = UnitZ(Factor=1)
md_slider_5 = MDSlider(SliderMode=0, slider_value=Point(0.5, 0.5, 0.5), x_domain=Domain(0, 1), y_domain=Domain(0, 1), z_domain=Domain(0, 1))
brep_16 = Brep(graft(debrep_4.Faces))
panel_446 = Panel("Contour Dachpfetten")
trim_9 = TrimTree(Tree=contour, Depth=1)
evalsrf_5 = EvaluateSurface(Surface=reparameterize(brep_16), Point=md_slider_5)  # -> Point, Normal, UDirection, VDirection, Frame
eval_7 = EvaluateCurve(Curve=reparameterize(trim_9), Parameter="0")  # -> Point, Tangent, Angle
neg_28 = Negative(Value=evalsrf_5.Normal)
unit = UnitVector(Vector=eval_7.Tangent)
multiplication_30 = Multiplication(A=neg_28, B=dachlattung_dimensionen)
multiplication_31 = Multiplication(A=unit, B=dachlattung_dimensionen)

# ---- group: Dachziegel
panel_448 = Panel("Dachaltten")
brep_17 = Brep(move_58.Geometry)
crv_47 = Curve(contour)
trim_10 = TrimTree(Tree=crv_47, Depth=1)
len_7 = Length(Curve=trim_10)
bnd_13 = Bounds(Numbers=len_7)
dedomain_10 = DeconstructDomain(Domain=bnd_13)  # -> Start, End
multiplication_32 = Multiplication(A=dedomain_10.End, B=Slider(5, range=0..10))
num_112 = Number(number_slider_6)
num_113 = Number(x_size)
division_5 = Division(A=multiplication_32, B=num_113)
round = Round(Number=division_5)  # -> Nearest, Floor, Ceiling

# ---- group: Dachlattung (continued)
contour_2 = Contour(Shape=debrep_4.Faces, Point=eval_6.Point, Direction=Z_107, Distance=num_113)
trim_11 = TrimTree(Tree=contour_2, Depth=1)
extr_78 = Extrude(Base=trim_11, Direction=multiplication_30)
extr_79 = Extrude(Base=extr_78, Direction=multiplication_31)
cull_i = CullIndex(List=extr_79, Indices="0", Wrap=True)
data_112 = Data(cull_i)

# ----
data_113 = Data([data_100, data_62, data_109, data_51, data_33, data_103, data_106, data_105, data_35, data_82, data_111, data_112, data_110, data_66])
custom_preview_7 = CustomPreview(Geometry=data_113, Material=create_material_2)

# ---- group: Dachziegel (continued)
item_11 = ListItem(List=extr_79, Index="0", Wrap=True)
bbox_2 = BoundingBox(Content=item_11, Plane=PlaneXY(0, 0, 0), UnionBox=False)  # -> Box, Box_2
debox_2 = DeconstructBox(Box=bbox_2.Box)  # -> Plane, X, Y, Z
num_114 = Number(debox_2.Z)
avr = Average(Input=flatten(num_114))

# ---- group: Dachziegel / Abstand Latte und Deckung
multiplication_33 = Multiplication(A=avr, B=Slider(1.5, range=0..10))

# ---- group: Dachziegel (continued)
panel_450 = Panel(multiplication_33)
Z_108 = UnitZ(Factor=multiplication_33)
move_64 = Move(Geometry=brep_17, Motion=Z_108)  # -> Geometry, Transform
brep_18 = Brep(move_64.Geometry)
debrep_5 = DeconstructBrep(Brep=move_64.Geometry)  # -> Faces, Edges, Vertices
edges_13 = BrepEdges(Brep=brep_18)  # -> Naked, Interior, NonManifold
pframe = PerpFrame(Curve=reparameterize(edges_13.Naked), Parameter="0.5")
eval_8 = EvaluateCurve(Curve=reparameterize(edges_13.Naked), Parameter="0")  # -> Point, Tangent, Angle
len_8 = Length(Curve=edges_13.Naked)
cir_2 = Circle(Plane=pframe, Radius=Slider(0.1, range=0..1))
eval_9 = EvaluateCurve(Curve=reparameterize(edges_13.Naked), Parameter="0.5")  # -> Point, Tangent, Angle
bcx_6 = BrepCurve(Brep=brep_18, Curve=cir_2)  # -> Curves, Points
multiplication_34 = Multiplication(A=len_8, B=Slider(6, range=0..10))
trim_12 = TrimTree(Tree=bcx_6.Points, Depth=1)
multiplication_35 = Multiplication(A=len_8, B="0.5")
vec2pt = Vector2Pt(PointA=eval_9.Point, PointB=trim_12, Unitize=False)  # -> Vector, Length
rev_3 = Reverse(Vector=eval_8.Tangent)
multiplication_36 = Multiplication(A=rev_3, B=multiplication_35)
move_65 = Move(Geometry=eval_8.Point, Motion=multiplication_36)  # -> Geometry, Transform
division_6 = Division(A=multiplication_34, B=num_112)
round_2 = Round(Number=division_6)  # -> Nearest, Floor, Ceiling
ptplanar = PlanarGrid(
    BasePoint=move_65.Geometry,
    IDir=eval_8.Tangent,
    JDir=vec2pt.Vector,
    IDistance=num_112,
    JDistance=num_113,
    INumber=round.Nearest,
    JNumber=round_2.Nearest)

# ---- group: Dachziegel / Ziegel, Performance Turnoff
pttrim = TrimGrid(Grid=ptplanar, BRep=debrep_5.Faces)
ptorient = OrientToGrid(Grid=pttrim, PatternObjects=rotate_5.Geometry, Shift_i=1, Shift_j=1, Rigid=False, Flip=False)  # disabled
panel_451 = Panel("Output Data Ziegel")  # disabled
data_114 = Data(ptorient)  # disabled

# ----
data_115 = Data(data_114)
custom_preview_8 = CustomPreview(Geometry=data_115, Material=create_material_5)

# ---- group: Schürzen
panel_452 = Panel("Joined Brep Dach")
edges_14 = BrepEdges(Brep=join_8.Breps)  # -> Naked, Interior, NonManifold
move_66 = Move(Geometry=edges_14.Naked, Motion=neg_27)  # -> Geometry, Transform
crv_48 = Curve(move_66.Geometry)
join_14 = JoinCurves(Curves=crv_48, Preserve=False)

# ---- group: Kantenabdeckung
brep_19 = Brep(move_64.Geometry)
Z_109 = UnitZ(Factor=Slider(0.035, range=0..1))
number_slider_7 = Slider(0.01, range=0..0.1)
move_67 = Move(Geometry=brep_19, Motion=Z_109)  # -> Geometry, Transform
sqr = Square(Value=x_size)
sqr_2 = Square(Value=number_slider_6)
edges_15 = BrepEdges(Brep=move_67.Geometry)  # -> Naked, Interior, NonManifold
Z_110 = UnitZ(Factor=number_slider_7)
addition_21 = Addition(A=sqr, B=sqr_2)
crv_49 = Curve(edges_15.Interior)
extr_80 = Extrude(Base=move_67.Geometry, Direction=Z_110)
sqrt = SquareRoot(Value=addition_21)
pipe = Pipe(Curve=crv_49, Radius=sqrt, Caps=Slider(2, range=0..10))
fastsint_5 = FastSolidIntersect(
    FirstBrepSet=graft(pipe),
    SecondBrepSet=flatten(extr_80),
    Tolerance=0.01,
    strictFastSolidInt=True,
    trueIntFastSolidInt=False)

# ---- group: Schürzen (continued)
crv_50 = Curve(edges_15.Naked)
Z_111 = UnitZ(Factor=number_slider_7)
move_68 = Move(Geometry=crv_50, Motion=Z_111)  # -> Geometry, Transform
join_15 = JoinCurves(Curves=move_68.Geometry, Preserve=False)
loft_5 = Loft(
    Curves=[join_15, join_14],
    Options={Adjust=False, Closed=False, LoftEnds=0, LoftSimp=0, LoftType=0, Rebuild=10, Refit=0.01})
flippsrf_2 = FlipPolysurface(Polysurface=loft_5)  # -> Flipped, R
offsrf_4 = OffsetSurface(Surface=flippsrf_2.Flipped, Distance=number_slider_7, BothSides=0, CreateSolid=True)

# ---- group: Kantenabdeckung (continued)
data_116 = Data([offsrf_4, fastsint_5])

# ----
data_117 = Data([data_83, data_28, data_34, data_116])
data_118 = Data(simplify(flatten([data_92, data_113, data_108, data_95, data_102, data_115, data_97, data_117, data_30])))
mesh = MeshBrep(
    Brep=data_118,
    Settings={GridMaxCount=0, GridMinCount=16, JaggedSeams=False, MaxEdgeLength=0, MinEdgeLength=0.0001, MinTolerance=0, Refine=True, RefineAngle=0, RelativeTolerance=0.65, SimplePlanes=True, Tolerance=0})
panel_455 = Panel(data_118)
mesh_2 = Mesh(mesh)
custom_preview_9 = CustomPreview(Geometry=data_117, Material=create_material_7)
null_2 = NullItem(Item=mesh_2)  # -> NullFlags, InvalidFlags, Description
invbool_2 = InvertBoolean(Boolean=null_2.NullFlags)  # -> Inverted, Number
cull_12 = CullPattern(List=mesh_2, CullPattern=invbool_2.Inverted)
mesh_3 = Mesh(simplify(graft(cull_12)))
panel_456 = Panel(mesh_3)
context_bake = ContextBake(Geometry=mesh_3)

# ==== cluster Cluster
wand = ClusterInput()
grundriss = ClusterInput()
wand_2 = Curve(wand)
grundriss_2 = Curve(grundriss)
snapping_edge = Slider(3, range=0..25)
eval = EvaluateCurve(Curve=reparameterize(grundriss_2), Parameter=".25")  # -> Point, Tangent, Angle
debrep = DeconstructBrep(Brep=wand_2)  # -> Faces, Edges, Vertices
panel = Panel(""".25
.75""")
pl = PlaneNormal(Origin=eval.Point, ZAxis=eval.Tangent)
eval_2 = EvaluateCurve(Curve=reparameterize(grundriss_2), Parameter=panel)  # -> Point, Tangent, Angle
item = ListItem(List=debrep.Vertices, Index=snapping_edge, Wrap=True)
A = ClusterInput()
crv_cp = CurveClosestPoint(Point=eval_2.Point, Curve=grundriss_2)  # -> Point, Parameter, Distance
pln = Plane(item)
rot3d = Rotate3D(Geometry=pl, Angle=degrees(A), Center=eval.Point, Axis=eval.Tangent)  # -> Geometry, Transform
shatter = Shatter(Curve=grundriss_2, Parameters=crv_cp.Parameter)
orient = Orient(Geometry=wand_2, Source=pln, Target=rot3d.Geometry)  # -> Geometry, Transform
swp1 = Sweep1(Rail=shatter, Sections=orient.Geometry, Miter=1)
join = BrepJoin(Breps=flatten(swp1))  # -> Breps, Closed
B = ClusterOutput(join.Breps)

# ==== cluster Cluster_2
crv = ClusterInput()
crv_2 = ClusterInput()
txt = ClusterInput()
txt_2 = ClusterInput()
brep = ClusterInput()
brep_2 = ClusterInput()
int = ClusterInput()

crv_3 = Curve(crv)
crv_4 = Curve(crv_2)

txt_3 = Text(txt)
txt_4 = Text(txt_2)
brep_3 = Brep(brep)
brep_4 = Brep(brep_2)
int_2 = Integer(int)
number_slider = Slider(0.139, range=0..10)
swatch = ColourSwatch(SwatchColor=RGB(0, 0, 0))
dash = DashPattern(Curve=crv_4, Pattern=[Slider(0.513, range=0..10), Slider(0.547, range=0..10)])  # -> Dashes, Gaps
previewlw = CustomPreviewLineweights(Geometry=dash.Dashes, Shader=swatch, Thickness=number_slider, Absolute=True)
previewlw_2 = CustomPreviewLineweights(Geometry=crv_3, Shader=swatch, Thickness=number_slider, Absolute=True)
txt_5 = Text(txt_4)
trim = TextTrim(Text=txt_3, Start=True, End=True)
len = TextLength(Text=txt_5)
min = Minimum(A="8", B=len)
fragment = TextFragment(Text=txt_5, Start="0", Count=min)
tmatch = MatchText(Text=fragment, Pattern="&&HALL&&", Case=True)
long = LongestList(ListA=tmatch, ListB="0", ListC="8", PaddingMode=2)  # -> ListA, ListB, ListC
brep_5 = Brep(brep_4)
brep_6 = Brep(brep_3)
p_n_c = PickNChoose(Pattern=tmatch, Stream0=long.ListB, Stream1=long.ListC)
fragment_2 = TextFragment(Text=txt_5, Start=p_n_c)
lng = ListLength(List=brep_6)
division = Division(A=".8", B=lng)
join = BrepJoin(Breps=flatten([brep_5, brep_6]))  # -> Breps, Closed
series = Series(Start=0, Step=division, Count=lng)
txt_6 = Text(fragment_2)
addition = Addition(A=series, B=Slider(0.704, range=0..1))
edges = BrepEdges(Brep=join.Breps)  # -> Naked, Interior, NonManifold
number_slider_2 = Slider(0.045, range=0..4)
crv_5 = Curve(edges.Naked)
area = Area(Geometry=brep_6)  # -> Area, Centroid
long_2 = LongestList(ListA=tmatch, ListB=Slider(0.656, range=0..1), ListC="1", PaddingMode=2)  # -> ListA, ListB, ListC
join_2 = JoinCurves(Curves=crv_5, Preserve=False)
crv_6 = Curve(simplify(brep_6))
p_n_c_2 = PickNChoose(Pattern=tmatch, Stream0=long_2.ListB, Stream1=long_2.ListC)
offset = Offset(Curve=flatten(join_2), Distance=expr("x/2", number_slider_2), Plane=PlaneXY(0, 0, 0), Corners=1)
screentext = ScreenOrientedText(Text=txt_6, Justification=7, Location=area.Centroid, SizeFactor=Slider(8, range=0..100), Depth=0, Absolute=False)
hsl = ColourHSL(Alpha=1, Hue=0, Saturation=0, Luminance=Slider(1, range=0..1))
hsl_2 = ColourHSL(Alpha=1, Hue=addition, Saturation=1, Luminance=p_n_c_2)
subtraction = Subtraction(A=hsl_2, B=ColourSwatch(SwatchColor=RGB(71, 71, 71)))  # -> simplify(Result)
previewmat = CustomPreviewMaterials(Geometry=brep_5, DiffuseColor=hsl)
previewlw_3 = CustomPreviewLineweights(Geometry=flatten(offset), Shader=ColourSwatch(SwatchColor=RGB(0, 0, 0)), Thickness=number_slider_2, Absolute=True)
previewlw_4 = CustomPreviewLineweights(Geometry=crv_6, Shader=subtraction, Thickness=Slider(0.069, range=0..4), Absolute=True)
previewmat_2 = CustomPreviewMaterials(Geometry=brep_6, DiffuseColor=hsl_2)

# ==== cluster FensterGenerator
kurven_himmelsrichtung = ClusterInput()
kurven_himmelsrichtung_2 = Curve(kurven_himmelsrichtung)
panel = Panel("Dicke Wandaufbau Innenände")
end = EndPoints(Curve=kurven_himmelsrichtung_2)  # -> Start, End
panel_2 = Panel("Punkte Innenwände")
panel_3 = Panel("Dicke Wandaufbau")
num = ClusterInput()
pt = ClusterInput()
num_2 = ClusterInput()
pt_2 = Point([end.Start, end.End])
num_3 = Number(num)
pt_3 = Point(pt)
num_4 = Number(num_2)
sph = Sphere(Base=pt_2, Radius=num_3)
sph_2 = Sphere(Base=pt_3, Radius=num_4)
data = Data(flatten([sph, sph_2]))
panel_4 = Panel("Augenhöhe")
trim = TrimWithBreps(Curve=kurven_himmelsrichtung_2, Brep=data)  # -> Inside, graft(Outside)
num_5 = ClusterInput()
mindestbreite_fenster = Slider(0.3, range=-0.3..0.7)
wwr_himmelsrichtung = ClusterInput()
panel_5 = Panel("Raumhöhe")
crv = Curve(trim.Outside)
num_6 = Number(num_5)
wwr_himmelsrichtung_2 = Number(wwr_himmelsrichtung)
num_7 = Number("1.6")
len = Length(Curve=crv)
subtraction = Subtraction(A=num_6, B=num_7)
graph = GraphMapper(wwr_himmelsrichtung_2, x0=0, x1=1, y0=0, y1=1, Gx=0.5, Gy=0.7071067812, Ox=0, Oy=0, container_name="Square Root")
graph_2 = GraphMapper(wwr_himmelsrichtung_2, x0=0, x1=1, y0=0, y1=1, Gx=0.5, Gy=0.7071067812, Ox=0, Oy=0, container_name="Square Root")
larger = LargerThan(FirstNumber=len, SecondNumber=mindestbreite_fenster)  # -> LargerThan, OrEqualTo
subtraction_2 = Subtraction(A=num_6, B=subtraction)
cull = CullPattern(List=crv, CullPattern=larger.LargerThan)
cull_2 = CullPattern(List=len, CullPattern=larger.LargerThan)
maximalbreite_fenster = Slider(2, range=0..10)
num_8 = Number(graph_2)
remap = RemapNumbers(Value=cull_2, Source=Domain(0, 1), Target=graph)  # -> Mapped, Clipped
graph_3 = GraphMapper(
    num_8,
    x0=0,
    x1=1,
    y0=0,
    y1=1,
    A=1,
    B=0,
    container_name="Linear",
    Graph_x0=0.25,
    Graph_x1=0.75,
    Graph_y0=0.25,
    Graph_y1=0.75)
graph_4 = GraphMapper(num_8, x0=0, x1=1, y0=0, y1=1, container_name="Bezier", cpx=[0, 0, 0, 1], cpy=[0, 0, 1, 1])
division = Division(A=remap.Mapped, B=maximalbreite_fenster)
round = Round(Number=division)  # -> Nearest, Floor, Ceiling
remap_2 = RemapNumbers(Value=subtraction_2, Source=Domain(0, 1), Target=graph_4)  # -> Mapped, Clipped
remap_3 = RemapNumbers(Value=subtraction, Source=Domain(0, 1), Target=graph_3)  # -> Mapped, Clipped
addition = Addition(A=remap_2.Mapped, B=remap_3.Mapped)
# Anzahl Fenster der Seite
anzahl_fenster_der_seite = Number(round.Ceiling)
panel_6 = Panel(round.Ceiling)
Z = UnitZ(Factor=remap_3.Mapped)
panel_7 = Panel("Einzelkurven der Himmelsrichtung")
division_2 = Division(A=remap.Mapped, B=round.Ceiling)
num_9 = Number(addition)
crv_2 = Curve(cull)
divide = DivideCurve(Curve=crv_2, Count=anzahl_fenster_der_seite, Kinks=False)  # -> Points, Tangents, Parameters
multiplication = Multiplication(A=num_9, B=remap.Mapped)
multiplication_2 = Multiplication(A=len, B=num_6)
item = ListItem(List=divide.Tangents, Index=Slider(0, range=0..100), Wrap=True)
shatter = Shatter(Curve=graft(crv_2), Parameters=divide.Parameters)
division_3 = Division(A=multiplication, B=multiplication_2)
midpt = CurveMiddle(Curve=shatter)
Z_2 = UnitZ(Factor=num_7)
wwr_actual = Number(division_3)
move = Move(Geometry=midpt, Motion=Z_2)  # -> Geometry, Transform
panel_9 = Panel(wwr_actual)
multiplication_3 = Multiplication(A=division_2, B=item)
panel_10 = Panel("WWR Actual")
Z_3 = UnitZ(Factor=1)
multiplication_4 = Multiplication(A="-0.5", B=multiplication_3)
extr = Extrude(Base=shatter, Direction=Z_3)
move_2 = Move(Geometry=move.Geometry, Motion=multiplication_4)  # -> Geometry, Transform
md_slider = MDSlider(SliderMode=0, slider_value=Point(0.5, 0.5, 0.5), x_domain=Domain(0, 1), y_domain=Domain(0, 1), z_domain=Domain(0, 1))
evalsrf = EvaluateSurface(Surface=reparameterize(extr), Point=md_slider)  # -> Point, Normal, UDirection, VDirection, Frame
cullpt = CullDuplicates(Points=move_2.Geometry, Tolerance=0.1, CullMode=3)  # -> Points, Indices, Valence
vec = Vector(item)
pl = ConstructPlane(Origin=move_2.Geometry, XAxis=item, YAxis=evalsrf.Normal)
num_10 = ClusterInput()
panel_11 = Panel("Dicke Wandaufbau gesamt")
num_11 = Number(num_10)
rectangle = Rectangle(Plane=pl, XSize=division_2, YSize=num_11, Radius=0)  # -> Rectangle, Length
panel_12 = Panel("Höhe über Auenhöhe")
move_3 = Move(Geometry=rectangle.Rectangle, Motion=Z)  # -> Geometry, Transform
move_4 = Move(Geometry=move_2.Geometry, Motion=Z)  # -> Geometry, Transform
panel_13 = Panel("Höhe Fenster Gesamt")
clean = CleanTree(RemoveNulls=True, RemoveInvalid=True, RemoveEmpty=Toggle(True), Tree=move_3.Geometry)
neg = Negative(Value=num_9)
boxrec = BoxRectangle(Rectangle=clean, Height=neg)
B = ClusterOutput(boxrec)
panel_14 = Panel("Breite Fenster")
num_12 = Number(division_2)
item_2 = ListItem(List=divide.Tangents, Index="1", Wrap=True)
multiplication_5 = Multiplication(A=num_12, B="0.5")
item_3 = ListItem(List=vec, Index="1", Wrap=True)
multiplication_6 = Multiplication(A=multiplication_5, B=item_2)
item_4 = ListItem(List=evalsrf.Normal, Index="1", Wrap=True)
move_5 = Move(Geometry=move_4.Geometry, Motion=multiplication_6)  # -> Geometry, Transform
vec_2 = Vector(item_3)
panel_17 = Panel("Fenster Höhe")
cullpt_2 = CullDuplicates(Points=move_5.Geometry, Tolerance=0.1, CullMode=3)  # -> Points, Indices, Valence
multiplication_7 = Multiplication(A=vec_2, B=num_12)
num_13 = Number(num_9)
num_14 = Number(num_11)
pt_4 = Point(cullpt_2.Points)
neg_2 = Negative(Value=num_13)
multiplication_8 = Multiplication(A=item_4, B=num_14)
Z_4 = UnitZ(Factor=neg_2)
multiplication_9 = Multiplication(A=multiplication_7, B="0.5")
multiplication_10 = Multiplication(A=multiplication_7, B="-0.5")
panel_18 = Panel("Innere Ecken Oben")
panel_19 = Panel("Innere Ecken Unten")
move_6 = Move(Geometry=pt_4, Motion=multiplication_9)  # -> graft(Geometry), Transform
move_7 = Move(Geometry=pt_4, Motion=multiplication_10)  # -> graft(Geometry), Transform
move_8 = Move(Geometry=move_7.Geometry, Motion=Z_4)  # -> Geometry, Transform
move_9 = Move(Geometry=move_6.Geometry, Motion=Z_4)  # -> Geometry, Transform
panel_20 = Panel("Äußere Ecken Oben")
panel_21 = Panel("Äußere Ecken Unten")
move_10 = Move(Geometry=move_6.Geometry, Motion=multiplication_8)  # -> Geometry, Transform
move_11 = Move(Geometry=move_10.Geometry, Motion=Z_4)  # -> Geometry, Transform
move_12 = Move(Geometry=move_7.Geometry, Motion=multiplication_8)  # -> Geometry, Transform
move_13 = Move(Geometry=move_12.Geometry, Motion=Z_4)  # -> Geometry, Transform
panel_22 = Panel(move_11.Geometry)
pline = PolyLine(Vertices=[move_9.Geometry, move_11.Geometry, move_13.Geometry, move_8.Geometry], Closed=Toggle(True))
pline_2 = PolyLine(Vertices=[move_6.Geometry, move_7.Geometry, move_12.Geometry, move_10.Geometry], Closed=Toggle(True))
pline_3 = PolyLine(Vertices=[move_6.Geometry, move_10.Geometry, move_11.Geometry, move_9.Geometry], Closed=Toggle(True))
pline_4 = PolyLine(Vertices=[move_12.Geometry, move_7.Geometry, move_8.Geometry, move_13.Geometry], Closed=Toggle(True))
fpatch = FragmentPatch(Boundary=pline)
fpatch_2 = FragmentPatch(Boundary=pline_2)
fpatch_3 = FragmentPatch(Boundary=pline_3)
fpatch_4 = FragmentPatch(Boundary=pline_4)
panel_23 = Panel("Tangente Vektor")
panel_24 = Panel("Dicke Rahmen")
panel_25 = Panel("Oben")
panel_26 = Panel("Unten")
panel_27 = Panel("1")
panel_28 = Panel("2")
vec_3 = Vector(vec)
item_5 = ListItem(List=vec_3, Index="1", Wrap=True)
dicke_rahmen = Slider(0.03, range=0..0.1)
num_15 = Number(dicke_rahmen)
neg_3 = Negative(Value=num_15)
Z_5 = UnitZ(Factor=neg_3)
move_14 = Move(Geometry=move_7.Geometry, Motion=Z_5)  # -> Geometry, Transform
move_15 = Move(Geometry=move_6.Geometry, Motion=Z_5)  # -> Geometry, Transform
join = BrepJoin(Breps=[fpatch, fpatch_3, fpatch_4, pline_2])  # -> Breps, Closed
multiplication_11 = Multiplication(A=item_5, B=dicke_rahmen)
panel_30 = Panel("Dicke Fußplatte")
vec_4 = Vector(multiplication_11)
offsetbrep = OffsetBrep(Brep=join.Breps, OffsetDistance=dicke_rahmen, Solid=Toggle(True), SharpEdges=True, Tolerance=0.01)
rev = Reverse(Vector=vec_4)
output_fensterrahmen = Data(offsetbrep)
num_16 = Number(dicke_rahmen)
num_17 = Number(dicke_rahmen)
move_16 = Move(Geometry=move_15.Geometry, Motion=rev)  # -> Geometry, Transform
move_17 = Move(Geometry=move_14.Geometry, Motion=vec_4)  # -> Geometry, Transform
num_18 = Number(num_13)
output_fensterrahmen_2 = ClusterOutput(output_fensterrahmen)
addition_2 = Addition(A=num_16, B=num_17)
subtraction_3 = Subtraction(A=num_18, B=addition_2)
panel_32 = Panel("Türblatt Grundform")
neg_4 = Negative(Value=subtraction_3)
Z_6 = UnitZ(Factor=neg_4)
move_18 = Move(Geometry=move_16.Geometry, Motion=Z_6)  # -> Geometry, Transform
move_19 = Move(Geometry=move_17.Geometry, Motion=Z_6)  # -> Geometry, Transform
pline_5 = PolyLine(Vertices=[move_17.Geometry, move_16.Geometry, move_18.Geometry, move_19.Geometry], Closed=Toggle(True))
fpatch_5 = FragmentPatch(Boundary=pline_5)
panel_33 = Panel("Normal Vektor Wand")
vec_5 = Vector(evalsrf.Normal)
num_19 = Number(num_11)
item_6 = ListItem(List=vec_5, Index="1", Wrap=True)
multiplication_12 = Multiplication(A=num_19, B=Slider(0.5, range=0..1))
multiplication_13 = Multiplication(A=item_6, B=multiplication_12)
move_20 = Move(Geometry=fpatch_5, Motion=multiplication_13)  # -> Geometry, Transform
G = ClusterOutput(move_20.Geometry)
offsrf = OffsetSurface(Surface=move_20.Geometry, Distance=Slider(0.05, range=0..0.1), BothSides=0, CreateSolid=True)
output_glas = Data(offsrf)
output_glas_2 = ClusterOutput(output_glas)
